# Grasshopper definition arraytest.ghx (Grasshopper 1.0.7)

pt = ConstructPoint(XCoordinate="0", YCoordinate="0", ZCoordinate="0")
pt_2 = ConstructPoint(XCoordinate="10000", YCoordinate="0", ZCoordinate="0")
ln = Line(StartPoint=pt, EndPoint=pt_2)
divide = DivideCurve(Curve=ln, Count="5", Kinks=False)  # -> Points, Tangents, Parameters
Z = UnitZ(Factor="1000")
move = Move(Geometry=divide.Points, Motion=Z)  # -> Geometry, Transform
neg = Negative(Value="100")
ln_2 = Line(StartPoint=divide.Points, EndPoint=move.Geometry)
Y = UnitY(Factor="100")
Y_2 = UnitY(Factor=neg)
move_2 = Move(Geometry=ln_2, Motion=Y_2)  # -> Geometry, Transform
move_3 = Move(Geometry=ln_2, Motion=Y)  # -> Geometry, Transform
rulesrf = RuledSurface(CurveA=move_2.Geometry, CurveB=move_3.Geometry)
