# Grasshopper definition brugtest.ghx (Grasshopper 1.0.7)

toog = BooleanToggle(True)
breedte = Slider(3000, range=1000..6000)
lengte = Slider(10000, range=3000..25000)
toog_2 = Slider(200, range=100..1000)
equals = Equality(FirstNumber=toog, SecondNumber="True")  # -> Equality, Inequality
division = Division(A=breedte, B="2")
neg = Negative(Value=division)
division_2 = Division(A=lengte, B="55")
panel = Panel("""True
False""")
pt = ConstructPoint(XCoordinate="0", YCoordinate="0", ZCoordinate="0")
pt_2 = ConstructPoint(XCoordinate=lengte, YCoordinate="0", ZCoordinate="0")
pt_3 = ConstructPoint(XCoordinate="0", YCoordinate=neg, ZCoordinate="0")
pt_4 = ConstructPoint(XCoordinate="0", YCoordinate=division, ZCoordinate="0")
neg_2 = Negative(Value=division_2)
fsim = FindSimilarMember(Data=equals.Equality, Set=panel)  # -> Hit, Index
Z = UnitZ(Factor=neg_2)
ln = Line(StartPoint=pt_3, EndPoint=pt_4)
ln_2 = Line(StartPoint=pt, EndPoint=pt_2)
move = Move(Geometry=ln, Motion=Z)  # -> Geometry, Transform
midpt = CurveMiddle(Curve=ln_2)
Z_2 = UnitZ(Factor=toog_2)
rulesrf = RuledSurface(CurveA=move.Geometry, CurveB=ln)
move_2 = Move(Geometry=midpt, Motion=Z_2)  # -> Geometry, Transform
ln_3 = Line(StartPoint=pt, EndPoint=pt_2)
arc = Arc3Pt(PointA=pt, PointB=move_2.Geometry, PointC=pt_2)  # -> Arc, Plane, Radius
item = ListItem(List=[arc.Arc, ln_3], Index=fsim.Index, Wrap=True)
material = CreateMaterial(Diffuse="123;123;123", Specular="255;255;255", Emission="0;0;0", Transparency="0", Shine="20")
swp1 = Sweep1(Rail=item, Sections=rulesrf, Miter=1)
preview = CustomPreview(Geometry=swp1, Material=material)
