# Grasshopper definition galerij.ghx (Grasshopper 1.0.7)
# plug-ins: ShapeDiverForGrasshopper

sddp = ShapeDiverDocumentPayload({AbsoluteTolerance=0, AngleTolerance=0, DistanceDisplayPrecision=0, GltfVersion="Gltf2", GrasshopperVersion="1.0.0007", InputGroups="{}", OutputGroups="{}", RelativeTolerance=0, RhinoVersion="7.38.24338.17001", UnitSystem=0, VersionCreated="1.15.0.0", VersionSaved="1.15.0.0"})

verdieping_bodem_h = Slider(3000, range=2500..5000)
verdiepingen_tussen_h = Slider(2800, range=2500..4000)
verdieping_top_h = Slider(1000, range=1000..5000)
regel_hoogte_boven_vloerdelen = Slider(1100, range=1000..5000)
tussen_verdiepingen_aantal = Slider(2, range=0..20)

vloerframe_hoogte = Slider(170, range=50..300)
vloerframe_dikte = Slider(70, range=50..300)
vloer_frame_oversteek_straatkant = Slider(50, range=0..100)
dekdeel_dikte = Slider(30, range=5..50)
vloerframe_x_as_afstand_van_muur = Slider(81, range=0..200)
dekdelen_tussenruimte = Slider(10, range=3..20)

dekdeel_breedte = Slider(150, range=5..300)
dekdeel_vloerframe_oversteek_muurkant = Slider(0, range=0..200)

kolommen_afstaand_hart_hart_x_as = Slider(2727, range=2500..3000)
kolommen_afstaand_muur_hart = Slider(2818, range=1500..3000)
kolommen_aantal = Slider(6, range=2..20)
kolommen_h = Slider(140, range=0..300)
kolommen_b = Slider(140, range=0..300)

muurzijde_ondersteuning = ValueList({"STAAL GEVELBEVESTIGING": 0, "KOLLOMMEN": 1}, selected="KOLLOMMEN")
_170x70mm_balk_afstand_van_muur_bij_staa = Slider(200, range=0..2000)  # "170X70MM BALK AFSTAND VAN MUUR BIJ STAAL GEVELBEVESTIGING"

# ---- group: VERDIEPINGEN HOOGTE Y AS
division = Division(A=vloerframe_hoogte, B="2")
# KOLOMMEN
addition = Addition(A=verdieping_bodem_h, B=verdiepingen_tussen_h)
multiplication = Multiplication(A=verdiepingen_tussen_h, B=tussen_verdiepingen_aantal)
addition_2 = Addition(A=regel_hoogte_boven_vloerdelen, B=division, C=dekdeel_dikte)
series = Series(Start=addition, Step=verdiepingen_tussen_h, Count=tussen_verdiepingen_aantal)  # -> flatten(Series)
addition_3 = Addition(A=verdieping_bodem_h, B=multiplication, C=addition_2)
merge = Merge(Data1=verdieping_bodem_h, Data2=series, Data3=addition_3)  # -> graft(Result)
Z = UnitZ(Factor=merge)

# ----
division_2 = Division(A=vloerframe_dikte, B="2")
division_3 = Division(A=kolommen_h, B="2")

# ---- group: KOLOMMEN X/Y ASSEN AFSTANDEN HART-HART
subtraction = Subtraction(A=kolommen_aantal, B="1")
xy = XYPlane(Origin=Point(0, 0, 0))
series_2 = Series(Start=kolommen_afstaand_hart_hart_x_as, Step=kolommen_afstaand_hart_hart_x_as, Count=subtraction)
neg = Negative(Value=kolommen_afstaand_muur_hart)
pt = Point(xy)
X = UnitX(Factor=series_2)
Y = UnitY(Factor=neg)
move = Move(Geometry=pt, Motion=Y)  # -> Geometry, Transform
move_2 = Move(Geometry=move.Geometry, Motion=X)  # -> Geometry, Transform
merge_2 = Merge(Data1=move.Geometry, Data2=move_2.Geometry)  # -> flatten(Result)
Z_2 = UnitZ(Factor=addition_3)
move_3 = Move(Geometry=merge_2, Motion=Z_2)  # -> Geometry, Transform
move_4 = Move(Geometry=merge_2, Motion=Z)  # -> flatten(Geometry), Transform
ln = Line(StartPoint=merge_2, EndPoint=move_3.Geometry)

# ---- group: - TOP PUNT
lng = ListLength(List=merge_2)
series_3 = Series(Start="-1", Step="-1", Count=lng)
cull_i = CullIndex(List=move_4.Geometry, Indices=series_3, Wrap=True)

# ---- group: KOLOMMEN SWEEP
division_4 = Division(A=kolommen_h, B="2")
division_5 = Division(A=kolommen_b, B="2")
neg_2 = Negative(Value=division_4)
neg_3 = Negative(Value=division_5)
dom = ConstructDomain(DomainStart=division_4, DomainEnd=neg_2)
dom_2 = ConstructDomain(DomainStart=division_5, DomainEnd=neg_3)
pln = Plane(merge_2)
rectangle = Rectangle(Plane=pln, XSize=dom_2, YSize=dom, Radius=0)  # -> graft(Rectangle), Length
srf = Surface(rectangle.Rectangle)
swp1 = Sweep1(Rail=ln, Sections=rectangle.Rectangle, Miter=1)
move_5 = Move(Geometry=srf, Motion=Z_2)  # -> Geometry, Transform

# ---- group: OVERSTEEK ZIJKANT
addition_4 = Addition(A=vloer_frame_oversteek_straatkant, B=division_4)
neg_4 = Negative(Value=addition_4)
Y_2 = UnitY(Factor=neg_4)
move_6 = Move(Geometry=cull_i, Motion=Y_2)  # -> Geometry, Transform

# ----
# VLOERFRAME X-AS
item = ListItem(List=flatten(cull_i), Index=0, Wrap=True)
addition_5 = Addition(A=division_3, B=vloerframe_dikte)
addition_6 = Addition(A=division_3, B=division_2)
X_2 = UnitX(Factor=addition_5)
move_7 = Move(Geometry=item, Motion=X_2)  # -> Geometry, Transform
Y_3 = UnitY(Factor=addition_6)
move_8 = Move(Geometry=move_7.Geometry, Motion=Y_3)  # -> Geometry, Transform
pdecon = Deconstruct(Point=move_8.Geometry)  # -> XComponent, YComponent, ZComponent
Z_3 = UnitZ(Factor=verdiepingen_tussen_h)
subtraction_2 = Subtraction(A=kolommen_aantal, B="1")
addition_7 = Addition(A=tussen_verdiepingen_aantal, B="1")

# ----
# DEKDELEN
panel = Panel("1")
subtraction_3 = Subtraction(A=kolommen_aantal, B=panel)
Z_4 = UnitZ(Factor=division)
addition_8 = Addition(A=kolommen_h, B=vloer_frame_oversteek_straatkant)
Y_4 = UnitY(Factor=addition_8)
X_3 = UnitX(Factor=division_2)
X_4 = UnitX(Factor=division_2)
neg_5 = Negative(Value=X_3)
neg_6 = Negative(Value=dekdeel_vloerframe_oversteek_muurkant)
addition_9 = Addition(A=dekdeel_breedte, B=dekdelen_tussenruimte)
X_5 = UnitX(Factor=dekdeel_breedte)
division_6 = Division(A=dekdeel_breedte, B=2)
X_6 = UnitX(Factor=division_6)
X_7 = UnitX(Factor=addition_9)
division_7 = Division(A=dekdeel_dikte, B="2")
Z_5 = UnitZ(Factor=division_7)
X_8 = UnitX(Factor=dekdelen_tussenruimte)
Y_5 = UnitY(Factor=1)
division_8 = Division(A=dekdeel_breedte, B="2")
Z_6 = UnitZ(Factor=dekdeel_dikte)
Z_7 = UnitZ(Factor=verdiepingen_tussen_h)
addition_10 = Addition(A=tussen_verdiepingen_aantal, B="1")
division_9 = Division(A=dekdeel_breedte, B="2")
division_10 = Division(A=dekdeel_dikte, B="2")
neg_7 = Negative(Value=division_9)
neg_8 = Negative(Value=division_10)
dom_3 = ConstructDomain(DomainStart=division_9, DomainEnd=neg_7)
dom_4 = ConstructDomain(DomainStart=division_10, DomainEnd=neg_8)

# ----
# VLOERFRAME Y-AS
addition_11 = Addition(A=division_3, B=division_2)
neg_9 = Negative(Value=addition_11)
X_9 = UnitX(Factor=addition_11)
X_10 = UnitX(Factor=neg_9)
move_9 = Move(Geometry=move_6.Geometry, Motion=graft(X_9))  # -> Geometry, Transform
move_10 = Move(Geometry=move_6.Geometry, Motion=graft(X_10))  # -> Geometry, Transform
pdecon_2 = Deconstruct(Point=move_9.Geometry)  # -> XComponent, YComponent, ZComponent
item_2 = ListItem(List=flatten(pdecon_2.YComponent), Index=0, Wrap=True)
neg_10 = Negative(Value=item_2)
subtraction_4 = Subtraction(A=neg_10, B=_170x70mm_balk_afstand_van_muur_bij_staa)
filter = StreamFilter(Gate=muurzijde_ondersteuning, Stream0=subtraction_4, Stream1=neg_10)
Y_6 = UnitY(Factor=filter)
move_11 = Move(Geometry=move_9.Geometry, Motion=Y_6)  # -> Geometry, Transform
move_12 = Move(Geometry=move_10.Geometry, Motion=Y_6)  # -> Geometry, Transform
division_11 = Division(A=vloerframe_hoogte, B=2)
division_12 = Division(A=vloerframe_dikte, B=2)
neg_11 = Negative(Value=division_11)
neg_12 = Negative(Value=division_12)
dom_5 = ConstructDomain(DomainStart=division_11, DomainEnd=neg_11)
dom_6 = ConstructDomain(DomainStart=division_12, DomainEnd=neg_12)

item_3 = ListItem(List=flatten(move_9.Geometry), Index=0, Wrap=True)
item_4 = ListItem(List=flatten(move_10.Geometry), Index="1", Wrap=True)
dist = Distance(PointA=item_3, PointB=item_4)
subtraction_5 = Subtraction(A=dist, B=vloerframe_dikte)
item_5 = ListItem(List=flatten(move_11.Geometry), Index=0, Wrap=True)
X_11 = UnitX(Factor=subtraction_5)
move_13 = Move(Geometry=move_8.Geometry, Motion=X_11)  # -> Geometry, Transform
pdecon_3 = Deconstruct(Point=item_5)  # -> XComponent, YComponent, ZComponent
ln_2 = Line(StartPoint=move_8.Geometry, EndPoint=move_13.Geometry)
addition_12 = Addition(A=vloerframe_x_as_afstand_van_muur, B=division_12)
subtraction_6 = Subtraction(A=pdecon_3.YComponent, B=pdecon.YComponent, C=addition_12)
Y_7 = UnitY(Factor=subtraction_6)
move_14 = Move(Geometry=ln_2, Motion=Y_7)  # -> Geometry, Transform
tweencrv = TweenCurve(CurveA=move_14.Geometry, CurveB=ln_2, Factor=0.5, BlendType=0)
merge_3 = Merge(Data1=move_14.Geometry, Data2=tweencrv, Data3=ln_2)
pframes = PerpFrames(Curve=merge_3, Count=1, Align=True)  # -> Frames, Parameters
cull_i_2 = CullIndex(List=pframes.Frames, Indices=-1, Wrap=True)
item_6 = ListItem(List=flatten(move_11.Geometry), Index=0, Wrap=True)  # -> Item, Item1, Item2
rectangle_2 = Rectangle(Plane=cull_i_2, XSize=dom_5, YSize=dom_6, Radius=0)  # -> Rectangle, Length
item_7 = ListItem(List=flatten(move_9.Geometry), Index=0, Wrap=True)
swp1_2 = Sweep1(Rail=ln_2, Sections=rectangle_2.Rectangle, Miter=1)
move_15 = Move(Geometry=item_6.Item1, Motion=Z_3)  # -> Geometry, Transform
merge_4 = Merge(Data1=merge_3, Data2=swp1_2)
box = Box2Pt(PointA=item_7, PointB=move_15.Geometry, Plane=PlaneXY(0, 0, 0))
arrbox = BoxArray(Geometry=merge_4, Cell=box, XCount=subtraction_2, YCount=1, ZCount=addition_7)  # -> Geometry, Transform

subtraction_7 = Subtraction(A=filter, B=kolommen_h, C=vloer_frame_oversteek_straatkant, D=neg_6)

ln_3 = Line(StartPoint=move_9.Geometry, EndPoint=move_11.Geometry)
ln_4 = Line(StartPoint=move_10.Geometry, EndPoint=move_12.Geometry)

pframes_2 = PerpFrames(Curve=[ln_3, ln_4], Count=1, Align=True)  # -> Frames, Parameters
cull_i_3 = CullIndex(List=pframes_2.Frames, Indices=-1, Wrap=True)
item_8 = ListItem(List=flatten(ln_3), Index=0, Wrap=True)
rectangle_3 = Rectangle(Plane=cull_i_3, XSize=dom_5, YSize=dom_6, Radius=0)  # -> Rectangle, Length

swp1_3 = Sweep1(Rail=item_8, Sections=rectangle_3.Rectangle, Miter=1)
srf_2 = Surface(rectangle_3.Rectangle)

item_9 = ListItem(List=flatten(move_9.Geometry), Index=subtraction_3, Wrap=True)
item_10 = ListItem(List=flatten(move_10.Geometry), Index=0, Wrap=True)
move_16 = Move(Geometry=[item_10, item_9], Motion=Z_4)  # -> Geometry, Transform
move_17 = Move(Geometry=move_16.Geometry, Motion=Y_4)  # -> Geometry, Transform
item_11 = ListItem(List=flatten(move_17.Geometry), Index=0, Wrap=True)  # -> Item, Item1
move_18 = Move(Geometry=item_11.Item1, Motion=X_4)  # -> Geometry, Transform
move_19 = Move(Geometry=item_11.Item, Motion=neg_5)  # -> Geometry, Transform
pln_2 = Plane(move_19.Geometry)
dist_2 = Distance(PointA=move_19.Geometry, PointB=move_18.Geometry)
Y_8 = UnitY(Factor=subtraction_7)
move_20 = Move(Geometry=move_19.Geometry, Motion=Y_8)  # -> Geometry, Transform
subtraction_8 = Subtraction(A=dist_2, B=division_6)
move_21 = Move(Geometry=move_20.Geometry, Motion=X_5)  # -> Geometry, Transform
division_13 = Division(A=subtraction_8, B=addition_9)
move_22 = Move(Geometry=[move_19.Geometry, move_20.Geometry], Motion=X_6)  # -> Geometry, Transform
rec_2pt = Rectangle2Pt(Plane=pln_2, PointA=move_19.Geometry, PointB=move_21.Geometry, Radius=0)  # -> Rectangle, Length
move_23 = Move(Geometry=move_22.Geometry, Motion=Z_5)  # -> Geometry, Transform
item_12 = ListItem(List=flatten(move_23.Geometry), Index=0, Wrap=True)  # -> Item, Item1
arrlinear = LinearArray(Geometry=rec_2pt.Rectangle, Direction=X_7, Count=division_13)  # -> Geometry, Transform
item_13 = ListItem(List=flatten(arrlinear.Geometry), Index="-1", Wrap=True)
cp = ControlPoints(Curve=item_13)  # -> Points, Weights, Knots
item_14 = ListItem(List=flatten(cp.Points), Index="1", Wrap=True)
move_24 = Move(Geometry=item_14, Motion=X_8)  # -> Geometry, Transform
move_25 = Move(Geometry=move_18.Geometry, Motion=Y_5)  # -> Geometry, Transform
pln_3 = Plane(move_24.Geometry)
rec_2pt_2 = Rectangle2Pt(Plane=pln_3, PointA=move_24.Geometry, PointB=move_25.Geometry, Radius=0)  # -> Rectangle, Length
wires = BrepWireframe(Brep=rec_2pt_2.Rectangle, Density=-1)
item_15 = ListItem(List=flatten(wires), Index=0, Wrap=True)
len = Length(Curve=item_15)
smaller = SmallerThan(FirstNumber=len, SecondNumber="60")  # -> SmallerThan, OrEqualTo
gate = StreamGate(Stream=rec_2pt_2.Rectangle, Gate=smaller.SmallerThan)  # -> Target0, Target1
division_14 = Division(A=len, B="2")
addition_13 = Addition(A=dekdelen_tussenruimte, B=division_14, C=division_8)
srf_3 = Surface(gate.Target0)
X_12 = UnitX(Factor=addition_13)
extr = Extrude(Base=srf_3, Direction=Z_6)
arrlinear_2 = LinearArray(Geometry=extr, Direction=Z_7, Count=addition_10)  # -> Geometry, Transform

ln_5 = Line(StartPoint=item_12.Item, EndPoint=item_12.Item1)
arrlinear_3 = LinearArray(Geometry=ln_5, Direction=X_7, Count=division_13)  # -> Geometry, Transform

item_16 = ListItem(List=flatten(arrlinear_3.Geometry), Index="-1", Wrap=True)
merge_5 = Merge(Data1=arrlinear_3.Geometry)
move_26 = Move(Geometry=item_16, Motion=X_12)  # -> Geometry, Transform
arrlinear_4 = LinearArray(Geometry=merge_5, Direction=Z_7, Count=addition_10)  # -> Geometry, Transform
pframes_3 = PerpFrames(Curve=arrlinear_4.Geometry, Count=1, Align=True)  # -> Frames, Parameters
item_17 = ListItem(List=pframes_3.Frames, Index=0, Wrap=True)
item_18 = ListItem(List=flatten(arrlinear_4.Geometry), Index=0, Wrap=True)
rectangle_4 = Rectangle(Plane=item_17, XSize=dom_4, YSize=dom_3, Radius=0)  # -> Rectangle, Length

swp1_4 = Sweep1(Rail=item_18, Sections=rectangle_4.Rectangle, Miter=1)
srf_4 = Surface(rectangle_4.Rectangle)

merge_6 = Merge(Data1=swp1_4, Data2=srf_4, Data3=arrbox.Geometry, Data4=swp1_3, Data5=srf_2, Data6=swp1, Data7=move_5.Geometry)
preview = CustomPreview(Geometry=merge_6, Material=ColourSwatch(SwatchColor=RGB(110, 55, 44)))
