# Grasshopper definition lijntest3.ghx (Grasshopper 1.0.7)

number_slider = Slider(1000, range=0..100000)
pt = ConstructPoint(XCoordinate=number_slider, YCoordinate="0", ZCoordinate=number_slider)
pt_2 = ConstructPoint(XCoordinate="500", YCoordinate="0", ZCoordinate="1200")
pt_3 = ConstructPoint(XCoordinate="0", YCoordinate="0", ZCoordinate=number_slider)
pt_4 = ConstructPoint(XCoordinate="0", YCoordinate="0", ZCoordinate="0")
pt_5 = ConstructPoint(XCoordinate=number_slider, YCoordinate="0", ZCoordinate="0")
pt_6 = ConstructPoint(XCoordinate="500", YCoordinate="0", ZCoordinate="100")
arc = Arc3Pt(PointA=pt_4, PointB=pt_6, PointC=pt_5)  # -> Arc, Plane, Radius
arc_2 = Arc3Pt(PointA=pt_3, PointB=pt_2, PointC=pt)  # -> Arc, Plane, Radius
