# Grasshopper definition Azobe_galerijen_APH_020.ghx (Grasshopper 1.0.7)
# plug-ins: ShapeDiverForGrasshopper, Pufferfish

sddp = ShapeDiverDocumentPayload({AbsoluteTolerance=0, AngleTolerance=0, DistanceDisplayPrecision=0, GltfVersion="Gltf2", GrasshopperVersion="1.0.0007", InputGroups="{}", OutputGroups="{}", RelativeTolerance=0, RhinoVersion="7.38.24338.17001", UnitSystem=0, VersionCreated="1.15.0.0", VersionSaved="1.15.0.0"})
muurzijde_ondersteuning = ValueList({"STAAL GEVELBEVESTIGING": 0, "KOLOMMEN": 1}, selected="STAAL GEVELBEVESTIGING")

verdiepingen_tussen_h = Slider(2500, range=2500..4000)
tussen_verdiepingen_aantal = Slider(1, range=0..3)
verdieping_bodem_h = Slider(2500, range=2500..5000)

vloerframe_hoogte = Slider(170, range=50..300)
vloerframe_dikte = Slider(70, range=50..300)
vloer_frame_oversteek_straatkant = Slider(50, range=0..100)
dekdeel_dikte = Slider(30, range=5..50)
dekdeel_breedte = Slider(150, range=5..300)
dekdelen_tussenruimte = Slider(10, range=3..20)
dekdeel_vloerframe_oversteek_muurkant = Slider(25, range=0..200)
vloerframe_x_as_afstand_van_y_as_vloerfr = Slider(81, range=0..200)  # "VLOERFRAME X-AS AFSTAND VAN Y-AS VLOERFRAME"

_170x70mm_balk_afstand_van_muur_bij_staa = Slider(100, range=0..2000)  # "170X70MM BALK AFSTAND VAN MUUR BIJ STAAL GEVELBEVESTIGING"
staal_gevelbevestiging_diepte = Slider(350, range=0..2000)
staal_materiaal_dikte = Slider(15, range=0..30)
staal_materiaal_hoogte = Slider(170, range=0..2000)
staal_materiaal_breedte = Slider(100, range=0..2000)

balustrade_hoogte = Slider(1100, range=0..2000)
balustrade_breedte = Slider(40, range=0..100)
balustrade_dikte = Slider(40, range=0..100)
balustrade_tussenruimte = Slider(40, range=0..100)

balkustradebalk_dikte = Slider(40, range=5..300)
balkustradebalk_hoogte = Slider(120, range=5..300)

kolommen_afstaand_hart_hart_x_as = Slider(2000, range=2000..3000)
kolommen_aantal = Slider(2, range=2..20)
kolommen_d = Slider(140, range=0..300)
kolommen_b = Slider(140, range=0..300)
kolommen_afstaand_muur_hart = Slider(2000, range=1500..3000)

kolom_bovenste_afsluiting = ValueList({"VLOER GELIJK": 0, "BALUSTRADE GELIJK": 1, "GEBOUW BEVESTIGT": 2}, selected="BALUSTRADE GELIJK")
kolom_top_dekdelen = Slider(2500, range=0..3000)

# ---- group: VERDIEPINGEN HOOGTE Y AS
division = Division(A=vloerframe_hoogte, B=2)
# KOLOMMEN
addition = Addition(A=verdieping_bodem_h, B=verdiepingen_tussen_h)
multiplication = Multiplication(A=verdiepingen_tussen_h, B=tussen_verdiepingen_aantal)
addition_2 = Addition(A=balustrade_hoogte, B=division, C=dekdeel_dikte)
series = Series(Start=addition, Step=verdiepingen_tussen_h, Count=tussen_verdiepingen_aantal)  # -> flatten(Series)
addition_3 = Addition(A=verdieping_bodem_h, B=multiplication, C=addition_2)
merge = Merge(Data1=verdieping_bodem_h, Data2=series, Data3=addition_3)  # -> graft(Result)
Z = UnitZ(Factor=merge)

# ----
division_2 = Division(A=vloerframe_dikte, B=2)
division_3 = Division(A=kolommen_d, B=2)

x_plus_one = XPlusOne(NumberX=kolommen_aantal)
multiplication_2 = Multiplication(A=kolommen_afstaand_hart_hart_x_as, B=x_plus_one)
division_4 = Division(A=multiplication_2, B=2)
pt = ConstructPoint(XCoordinate=0, YCoordinate="5000", ZCoordinate=0)
pt_2 = ConstructPoint(XCoordinate=division_4, YCoordinate=0, ZCoordinate=0)
multiplication_3 = Multiplication(A=verdiepingen_tussen_h, B=tussen_verdiepingen_aantal)
subtraction = Subtraction(A=division_4, B=kolommen_afstaand_hart_hart_x_as)
rec_3pt = Rectangle3Pt(PointA=pt_2, PointB=expr("-X", pt_2), PointC=pt)  # -> Rectangle, Length
addition_4 = Addition(A=verdieping_bodem_h, B=multiplication_3, C=balustrade_hoogte)
X = UnitX(Factor=subtraction)
move = Move(Geometry=rec_3pt.Rectangle, Motion=X)  # -> Geometry, Transform
addition_5 = Addition(A=addition_4, B=2000)
flip = FlipCurve(Curve=move.Geometry)  # -> Curve, Flag
boxrec = BoxRectangle(Rectangle=flip.Curve, Height=addition_5)
preview = CustomPreview(Geometry=boxrec, Material=ColourSwatch(SwatchColor=RGB(176, 176, 176)))

# ----
# DEKDELEN
panel = Panel("1")
subtraction_2 = Subtraction(A=kolommen_aantal, B=panel)
Z_2 = UnitZ(Factor=division)
addition_6 = Addition(A=kolommen_d, B=vloer_frame_oversteek_straatkant)
Y = UnitY(Factor=addition_6)
X_2 = UnitX(Factor=division_2)
X_3 = UnitX(Factor=division_2)
neg = Negative(Value=X_2)
neg_2 = Negative(Value=dekdeel_vloerframe_oversteek_muurkant)
addition_7 = Addition(A=dekdeel_breedte, B=dekdelen_tussenruimte)
X_4 = UnitX(Factor=dekdeel_breedte)
division_5 = Division(A=dekdeel_breedte, B=2)
X_5 = UnitX(Factor=division_5)
division_6 = Division(A=dekdeel_dikte, B=2)
Z_3 = UnitZ(Factor=division_6)
X_6 = UnitX(Factor=addition_7)
X_7 = UnitX(Factor=dekdelen_tussenruimte)
division_7 = Division(A=dekdeel_breedte, B="2")
Z_4 = UnitZ(Factor=dekdeel_dikte)
Z_5 = UnitZ(Factor=verdiepingen_tussen_h)
x_plus_one_2 = XPlusOne(NumberX=tussen_verdiepingen_aantal)
division_8 = Division(A=dekdeel_breedte, B=2)
division_9 = Division(A=dekdeel_dikte, B=2)
neg_3 = Negative(Value=division_8)
neg_4 = Negative(Value=division_9)
dom = ConstructDomain(DomainStart=division_8, DomainEnd=neg_3)
dom_2 = ConstructDomain(DomainStart=division_9, DomainEnd=neg_4)

# ----
# BALUSTRADEBALKEN
division_10 = Division(A=kolommen_b, B=2)
X_8 = UnitX(Factor=division_10)
division_11 = Division(A=balkustradebalk_dikte, B=2)
division_12 = Division(A=vloerframe_hoogte, B=2)
subtraction_3 = Subtraction(A=division_10, B=division_11)
Z_6 = UnitZ(Factor=division_12)
Y_2 = UnitY(Factor=subtraction_3)
subtraction_4 = Subtraction(A=kolommen_afstaand_hart_hart_x_as, B=kolommen_b)
X_9 = UnitX(Factor=subtraction_4)
division_13 = Division(A=balkustradebalk_dikte, B=2)
division_14 = Division(A=balkustradebalk_hoogte, B=2)
neg_5 = Negative(Value=division_13)
neg_6 = Negative(Value=division_14)
dom_3 = ConstructDomain(DomainStart=division_13, DomainEnd=neg_5)
dom_4 = ConstructDomain(DomainStart=division_14, DomainEnd=neg_6)
multiplication_4 = Multiplication(A=vloerframe_hoogte, B=2)

# ----
# BALUSTRADEN
Y_3 = UnitY(Factor=division_11)
Z_7 = UnitZ(Factor=vloerframe_hoogte)
X_10 = UnitX(Factor=kolommen_b)
multiplication_5 = Multiplication(A=balustrade_breedte, B="1.5")
addition_8 = Addition(A=balustrade_hoogte, B=vloerframe_hoogte, C=dekdeel_dikte)
Z_8 = UnitZ(Factor=verdiepingen_tussen_h)
addition_9 = Addition(A=balustrade_breedte, B=balustrade_tussenruimte)
division_15 = Division(A=balustrade_breedte, B=2)
division_16 = Division(A=balustrade_dikte, B=2)
neg_7 = Negative(Value=division_15)
neg_8 = Negative(Value=division_16)
dom_5 = ConstructDomain(DomainStart=division_15, DomainEnd=neg_7)
dom_6 = ConstructDomain(DomainStart=division_16, DomainEnd=neg_8)
Z_9 = UnitZ(Factor=addition_8)

# ----
# VLOERFRAME X-AS
addition_10 = Addition(A=division_3, B=vloerframe_dikte)
addition_11 = Addition(A=division_3, B=division_2)
X_11 = UnitX(Factor=addition_10)
Y_4 = UnitY(Factor=addition_11)
Z_10 = UnitZ(Factor=verdiepingen_tussen_h)
subtraction_5 = Subtraction(A=kolommen_aantal, B="1")
addition_12 = Addition(A=tussen_verdiepingen_aantal, B="1")

# ----
# STABILITEITSSTAVEN
stabiliteitsstaven_dikte = Slider(45, range=0..100)
stabiliteitsstaven_breedte = Slider(70, range=0..100)
division_17 = Division(A=vloerframe_hoogte, B=2)
division_18 = Division(A=stabiliteitsstaven_dikte, B=2)
subtraction_6 = Subtraction(A=division_17, B=division_18)
Z_11 = UnitZ(Factor=subtraction_6)
division_19 = Division(A=vloerframe_dikte, B=2)
division_20 = Division(A=stabiliteitsstaven_breedte, B=2)
addition_13 = Addition(A=division_19, B=division_20)
Y_5 = UnitY(Factor=addition_13)
division_21 = Division(A=stabiliteitsstaven_dikte, B=2)
division_22 = Division(A=stabiliteitsstaven_breedte, B=2)
neg_9 = Negative(Value=division_21)
neg_10 = Negative(Value=division_22)
dom_7 = ConstructDomain(DomainStart=division_21, DomainEnd=neg_9)
dom_8 = ConstructDomain(DomainStart=division_22, DomainEnd=neg_10)
x_minus_one = XMinusOne(NumberX=kolommen_aantal)
series_2 = Series(Start="0", Step=kolommen_afstaand_hart_hart_x_as, Count=x_minus_one)
series_3 = Series(Start=0, Step=1, Count=x_minus_one)
X_12 = UnitX(Factor=series_2)
mod = Modulus(A=series_3, B="2")

# ----
# STAAL GEVELBEVESTIGING
division_23 = Division(A=vloerframe_hoogte, B=2)
Z_12 = UnitZ(Factor=division_23)
Z_13 = UnitZ(Factor=staal_materiaal_dikte)
Y_6 = UnitY(Factor=_170x70mm_balk_afstand_van_muur_bij_staa)
Z_14 = UnitZ(Factor=staal_materiaal_hoogte)
Y_7 = UnitY(Factor=staal_gevelbevestiging_diepte)
division_24 = Division(A=staal_materiaal_breedte, B=2)
neg_11 = Negative(Value=division_24)
xz = XZPlane(Origin=Point(0, 0, 0))
addition_14 = Addition(A=kolommen_d, B=vloerframe_dikte)
X_13 = UnitX(Factor=staal_materiaal_breedte)
X_14 = UnitX(Factor=addition_14)

# ----
# KLOSSEN
division_25 = Division(A=vloerframe_dikte, B=2)
division_26 = Division(A=vloerframe_hoogte, B=2)
division_27 = Division(A=vloerframe_dikte, B=2)
neg_12 = Negative(Value=division_26)
neg_13 = Negative(Value=division_27)
dom_9 = ConstructDomain(DomainStart=division_26, DomainEnd=neg_12)
dom_10 = ConstructDomain(DomainStart=division_27, DomainEnd=neg_13)

# ----
# VLOERFRAME Y-AS
addition_15 = Addition(A=division_3, B=division_2)
neg_14 = Negative(Value=addition_15)
X_15 = UnitX(Factor=addition_15)
X_16 = UnitX(Factor=neg_14)
division_28 = Division(A=vloerframe_hoogte, B=2)
division_29 = Division(A=vloerframe_dikte, B=2)
neg_15 = Negative(Value=division_28)
neg_16 = Negative(Value=division_29)
dom_11 = ConstructDomain(DomainStart=division_28, DomainEnd=neg_15)
dom_12 = ConstructDomain(DomainStart=division_29, DomainEnd=neg_16)

# ---- group: KOLOMMEN X/Y ASSEN AFSTANDEN HART-HART
subtraction_7 = Subtraction(A=kolommen_aantal, B="1")
xy = XYPlane(Origin=Point(0, 0, 0))
series_4 = Series(Start=kolommen_afstaand_hart_hart_x_as, Step=kolommen_afstaand_hart_hart_x_as, Count=subtraction_7)
neg_17 = Negative(Value=kolommen_afstaand_muur_hart)
pt_3 = Point(xy)
X_17 = UnitX(Factor=series_4)
Y_8 = UnitY(Factor=neg_17)
move_2 = Move(Geometry=pt_3, Motion=Y_8)  # -> Geometry, Transform
move_3 = Move(Geometry=move_2.Geometry, Motion=X_17)  # -> Geometry, Transform
merge_2 = Merge(Data1=move_2.Geometry, Data2=move_3.Geometry)  # -> flatten(Result)
move_4 = Move(Geometry=merge_2, Motion=Z)  # -> flatten(Geometry), Transform

# ---- group: - TOP PUNT
lng = ListLength(List=merge_2)
series_5 = Series(Start="-1", Step="-1", Count=lng)
cull_i = CullIndex(List=move_4.Geometry, Indices=series_5, Wrap=True)

# ----
item = ListItem(List=flatten(cull_i), Index=0, Wrap=True)
move_5 = Move(Geometry=item, Motion=X_11)  # -> Geometry, Transform
move_6 = Move(Geometry=move_5.Geometry, Motion=Y_4)  # -> Geometry, Transform
pdecon = Deconstruct(Point=move_6.Geometry)  # -> XComponent, YComponent, ZComponent
addition_16 = Addition(A=vloerframe_x_as_afstand_van_y_as_vloerfr, B=division_29)

item_2 = ListItem(List=move_4.Geometry, Index=0, Wrap=True)
move_7 = Move(Geometry=item_2, Motion=X_8)  # -> Geometry, Transform
move_8 = Move(Geometry=move_7.Geometry, Motion=Z_6)  # -> Geometry, Transform
move_9 = Move(Geometry=move_8.Geometry, Motion=Y_2)  # -> Geometry, Transform
move_10 = Move(Geometry=move_9.Geometry, Motion=X_9)  # -> Geometry, Transform
yz = YZPlane(Origin=move_9.Geometry)
rectangle = Rectangle(Plane=yz, XSize=dom_3, YSize=dom_4, Radius=0)  # -> Rectangle, Length
subtraction_8 = Subtraction(A=addition_8, B=multiplication_4)
Z_15 = UnitZ(Factor=subtraction_8)

move_11 = Move(Geometry=move_9.Geometry, Motion=expr("-X", Y_3))  # -> Geometry, Transform
move_12 = Move(Geometry=move_11.Geometry, Motion=expr("-x", Z_7))  # -> Geometry, Transform
move_13 = Move(Geometry=move_12.Geometry, Motion=X_9)  # -> Geometry, Transform
ln = Line(StartPoint=move_12.Geometry, EndPoint=move_13.Geometry)
move_14 = Move(Geometry=move_13.Geometry, Motion=X_10)  # -> Geometry, Transform
ext = ExtendCurve(Curve=ln, Type=0, Start=expr("-x", multiplication_5), End=expr("-x", multiplication_5))
len = Length(Curve=ext)
move_15 = Move(Geometry=move_14.Geometry, Motion=Z_8)  # -> Geometry, Transform
division_30 = Division(A=len, B=addition_9)
xz_2 = XZPlane(Origin=move_12.Geometry)
divide = DivideCurve(Curve=ext, Count=division_30, Kinks=False)  # -> Points, Tangents, Parameters
rec_2pt = Rectangle2Pt(Plane=xz_2, PointA=move_12.Geometry, PointB=move_15.Geometry, Radius=0)  # -> Rectangle, Length
rectangle_2 = Rectangle(Plane=divide.Points, XSize=dom_5, YSize=dom_6, Radius=0)  # -> graft(Rectangle), Length
move_16 = Move(Geometry=divide.Points, Motion=Z_9)  # -> Geometry, Transform
move_17 = Move(Geometry=rectangle_2.Rectangle, Motion=Z_9)  # -> Geometry, Transform
ln_2 = Line(StartPoint=divide.Points, EndPoint=move_16.Geometry)
arrrec = RectangularArray(Geometry=ln_2, Cell=rec_2pt.Rectangle, XCount=subtraction_5, YCount=addition_12)  # -> Geometry, Transform
arrrec_2 = RectangularArray(Geometry=rectangle_2.Rectangle, Cell=rec_2pt.Rectangle, XCount=subtraction_5, YCount=addition_12)  # -> Geometry, Transform
swp1 = Sweep1(Rail=graft(arrrec.Geometry), Sections=graft(arrrec_2.Geometry), Miter=1)

lng_2 = ListLength(List=flatten(swp1))
balustrade_aantal = Panel(lng_2)

# ---- group: GEBOUW BEVESTIGING
division_31 = Division(A=kolommen_d, B=2)
Y_9 = UnitY(Factor=division_31)
Z_16 = UnitZ(Factor=division_31)
division_32 = Division(A=kolommen_d, B=2)
division_33 = Division(A=kolommen_b, B=2)
neg_18 = Negative(Value=division_32)
neg_19 = Negative(Value=division_33)
dom_13 = ConstructDomain(DomainStart=division_32, DomainEnd=neg_18)
dom_14 = ConstructDomain(DomainStart=division_33, DomainEnd=neg_19)

# ----
X_18 = UnitX(Factor=kolommen_afstaand_hart_hart_x_as)
X_19 = UnitX(Factor=kolommen_afstaand_hart_hart_x_as)

# ---- group: KOLOMMEN SWEEP
division_34 = Division(A=kolommen_d, B=2)
division_35 = Division(A=kolommen_b, B=2)
neg_20 = Negative(Value=division_34)
neg_21 = Negative(Value=division_35)
dom_15 = ConstructDomain(DomainStart=division_34, DomainEnd=neg_20)
dom_16 = ConstructDomain(DomainStart=division_35, DomainEnd=neg_21)
pln = Plane(merge_2)
rectangle_3 = Rectangle(Plane=pln, XSize=dom_16, YSize=dom_15, Radius=0)  # -> graft(Rectangle), Length
srf = Surface(rectangle_3.Rectangle)

# ---- group: OVERSTEEK ZIJKANT
addition_17 = Addition(A=vloer_frame_oversteek_straatkant, B=division_34)
neg_22 = Negative(Value=addition_17)
Y_10 = UnitY(Factor=neg_22)
move_18 = Move(Geometry=cull_i, Motion=Y_10)  # -> Geometry, Transform

# ----
move_19 = Move(Geometry=move_18.Geometry, Motion=graft(X_15))  # -> Geometry, Transform
move_20 = Move(Geometry=move_18.Geometry, Motion=graft(X_16))  # -> Geometry, Transform
pdecon_2 = Deconstruct(Point=move_19.Geometry)  # -> XComponent, YComponent, ZComponent
item_3 = ListItem(List=flatten(pdecon_2.YComponent), Index=0, Wrap=True)
neg_23 = Negative(Value=item_3)
subtraction_9 = Subtraction(A=neg_23, B=_170x70mm_balk_afstand_van_muur_bij_staa)
filter = StreamFilter(Gate=muurzijde_ondersteuning, Stream0=subtraction_9, Stream1=neg_23)
Y_11 = UnitY(Factor=filter)
move_21 = Move(Geometry=move_19.Geometry, Motion=Y_11)  # -> Geometry, Transform
move_22 = Move(Geometry=move_20.Geometry, Motion=Y_11)  # -> Geometry, Transform

move_23 = Move(Geometry=move_22.Geometry, Motion=expr("-x", Z_12))  # -> Geometry, Transform
move_24 = Move(Geometry=move_23.Geometry, Motion=expr("-x", Z_13))  # -> Geometry, Transform
move_25 = Move(Geometry=move_24.Geometry, Motion=Y_6)  # -> simplify(graft(Geometry)), Transform
move_26 = Move(Geometry=move_25.Geometry, Motion=Z_14)  # -> simplify(graft(Geometry)), Transform
move_27 = Move(Geometry=move_25.Geometry, Motion=expr("-X", Y_7))  # -> simplify(graft(Geometry)), Transform
pline = PolyLine(Vertices=[move_27.Geometry, move_25.Geometry, move_26.Geometry], Closed=False)
offset = OffsetCurve(Curve=pline, Distance=neg_11, Plane=xz, Corners=1)
offset_2 = OffsetCurve(Curve=offset, Distance=expr("-x", staal_materiaal_dikte), Corners=1)
end = EndPoints(Curve=offset)  # -> Start, End
end_2 = EndPoints(Curve=offset_2)  # -> Start, End
ln_3 = Line(StartPoint=end.Start, EndPoint=end_2.Start)
ln_4 = Line(StartPoint=end_2.End, EndPoint=end.End)
join = JoinCurves(Curves=[offset, ln_4, ln_3, offset_2], Preserve=False)
move_28 = Move(Geometry=join, Motion=X_14)  # -> Geometry, Transform
boundary = BoundarySurfaces(Edges=[join, move_28.Geometry])
extr = Extrude(Base=boundary, Direction=X_13)
filter_2 = StreamFilter(Gate=muurzijde_ondersteuning, Stream0=extr)

item_4 = ListItem(List=flatten(move_19.Geometry), Index=0, Wrap=True)
item_5 = ListItem(List=flatten(move_20.Geometry), Index="1", Wrap=True)
dist = Distance(PointA=item_4, PointB=item_5)
subtraction_10 = Subtraction(A=dist, B=vloerframe_dikte)
item_6 = ListItem(List=flatten(move_21.Geometry), Index=0, Wrap=True)
X_20 = UnitX(Factor=subtraction_10)
move_29 = Move(Geometry=move_6.Geometry, Motion=X_20)  # -> Geometry, Transform
pdecon_3 = Deconstruct(Point=item_6)  # -> XComponent, YComponent, ZComponent
ln_5 = Line(StartPoint=move_6.Geometry, EndPoint=move_29.Geometry)
subtraction_11 = Subtraction(A=pdecon_3.YComponent, B=pdecon.YComponent, C=addition_16)
Y_12 = UnitY(Factor=subtraction_11)
move_30 = Move(Geometry=ln_5, Motion=Y_12)  # -> Geometry, Transform
tweencrv = TweenCurve(CurveA=move_30.Geometry, CurveB=ln_5, Factor=0.5, BlendType=0)
merge_3 = Merge(Data1=move_30.Geometry, Data2=tweencrv, Data3=ln_5)
pframes = PerpFrames(Curve=merge_3, Count=1, Align=True)  # -> Frames, Parameters
cull_i_2 = CullIndex(List=pframes.Frames, Indices=-1, Wrap=True)
item_7 = ListItem(List=flatten(move_21.Geometry), Index=0, Wrap=True)  # -> Item, Item1, Item2
rectangle_4 = Rectangle(Plane=cull_i_2, XSize=dom_11, YSize=dom_12, Radius=0)  # -> Rectangle, Length
item_8 = ListItem(List=flatten(move_19.Geometry), Index=0, Wrap=True)
swp1_2 = Sweep1(Rail=ln_5, Sections=rectangle_4.Rectangle, Miter=1)
move_31 = Move(Geometry=item_7.Item1, Motion=Z_10)  # -> Geometry, Transform
merge_4 = Merge(Data1=merge_3, Data2=swp1_2)
box = Box2Pt(PointA=item_8, PointB=move_31.Geometry, Plane=PlaneXY(0, 0, 0))
arrbox = BoxArray(Geometry=merge_4, Cell=box, XCount=subtraction_5, YCount=1, ZCount=addition_12)  # -> Geometry, Transform

end_3 = EndPoints(Curve=ln_5)  # -> Start, End
end_4 = EndPoints(Curve=move_30.Geometry)  # -> Start, End
move_32 = Move(Geometry=end_3.Start, Motion=expr("-x", Z_11))  # -> Geometry, Transform
move_33 = Move(Geometry=end_4.End, Motion=expr("-x", Z_11))  # -> Geometry, Transform
move_34 = Move(Geometry=move_33.Geometry, Motion=expr("-x", Y_5))  # -> Geometry, Transform
move_35 = Move(Geometry=move_32.Geometry, Motion=Y_5)  # -> Geometry, Transform
ln_6 = Line(StartPoint=move_35.Geometry, EndPoint=move_34.Geometry)
ext_2 = ExtendCurve(Curve=ln_6, Type=0, Start=50, End=50)
pframes_2 = PerpFrames(Curve=ext_2, Count=1, Align=True)  # -> Frames, Parameters
rectangle_5 = Rectangle(Plane=pframes_2.Frames, XSize=dom_7, YSize=dom_8, Radius=0)  # -> Rectangle, Length
swp1_3 = Sweep1(Rail=ext_2, Sections=rectangle_5.Rectangle, Miter=1)
move_36 = Move(Geometry=swp1_3, Motion=X_12)  # -> Geometry, Transform
sift = SiftPattern(List=move_36.Geometry, SiftPattern=mod)  # -> Output0, Output1
area = Area(Geometry=sift.Output1)  # -> Area, Centroid
xz_3 = XZPlane(Origin=area.Centroid)
cull = CullPattern(List=move_36.Geometry, CullPattern=sift.Output0)
mirror = Mirror(Geometry=sift.Output1, Plane=xz_3)  # -> Geometry, Transform
entwine = Entwine(Branch00=cull, Branch01=mirror.Geometry, FlattenInputs=True)
arrlinear = LinearArray(Geometry=entwine, Direction=Z_5, Count=x_plus_one_2)  # -> Geometry, Transform

end_5 = EndPoints(Curve=move_30.Geometry)  # -> Start, End
pdecon_4 = Deconstruct(Point=end_5.Start)  # -> XComponent, YComponent, ZComponent
pdecon_5 = Deconstruct(Point=move_2.Geometry)  # -> XComponent, YComponent, ZComponent
abs = Absolute(Value=pdecon_4.YComponent)
abs_2 = Absolute(Value=pdecon_5.YComponent)
division_36 = Division(A=kolommen_d, B=2)
subtraction_12 = Subtraction(A=abs_2, B=abs, C=division_36)
Y_13 = UnitY(Factor=subtraction_12)
move_37 = Move(Geometry=rectangle_3.Rectangle, Motion=Y_13)  # -> Geometry, Transform
multiplication_6 = Multiplication(A=verdiepingen_tussen_h, B=tussen_verdiepingen_aantal)
division_37 = Division(A=vloerframe_hoogte, B=2)
area_2 = Area(Geometry=move_37.Geometry)  # -> Area, Centroid
addition_18 = Addition(A=verdieping_bodem_h, B=multiplication_6, C=division_37)
Z_17 = UnitZ(Factor=addition_18)
move_38 = Move(Geometry=area_2.Centroid, Motion=Z_17)  # -> Geometry, Transform
filter_3 = StreamFilter(Gate=muurzijde_ondersteuning, Stream1=move_37.Geometry)
ln_7 = Line(StartPoint=area_2.Centroid, EndPoint=move_38.Geometry)
swp1_4 = Sweep1(Rail=ln_7, Sections=filter_3, Miter=1)

# ---- group: VLOER/BALUSTRADE HOOGTE
addition_19 = Addition(A=kolom_top_dekdelen, B=addition_18, C=dekdeel_dikte)
filter_4 = StreamFilter(Gate=kolom_bovenste_afsluiting, Stream0=addition_18, Stream1=addition_3, Stream2=addition_19)

# ---- group: KOLOMMEN X/Y ASSEN AFSTANDEN HART-HART (continued)
Z_18 = UnitZ(Factor=filter_4)
move_39 = Move(Geometry=merge_2, Motion=Z_18)  # -> Geometry, Transform
ln_8 = Line(StartPoint=merge_2, EndPoint=move_39.Geometry)

# ----
ln_9 = Line(StartPoint=move_19.Geometry, EndPoint=move_21.Geometry)
ln_10 = Line(StartPoint=move_20.Geometry, EndPoint=move_22.Geometry)

pframes_3 = PerpFrames(Curve=[ln_9, ln_10], Count=1, Align=True)  # -> Frames, Parameters
cull_i_3 = CullIndex(List=pframes_3.Frames, Indices=-1, Wrap=True)
item_9 = ListItem(List=flatten(ln_9), Index=0, Wrap=True)
rectangle_6 = Rectangle(Plane=cull_i_3, XSize=dom_11, YSize=dom_12, Radius=0)  # -> Rectangle, Length

# ---- group: KOLOMMEN SWEEP (continued)
item_10 = ListItem(List=flatten(ln_8), Index=0, Wrap=True)
move_40 = Move(Geometry=srf, Motion=Z_18)  # -> Geometry, Transform
swp1_5 = Sweep1(Rail=item_10, Sections=graft(rectangle_3.Rectangle), Miter=1)

# ---- group: GEBOUW BEVESTIGING (continued)
area_3 = Area(Geometry=move_40.Geometry)  # -> Area, Centroid
move_41 = Move(Geometry=area_3.Centroid, Motion=Y_9)  # -> Geometry, Transform
move_42 = Move(Geometry=move_41.Geometry, Motion=expr("-x", Z_16))  # -> Geometry, Transform
item_11 = ListItem(List=flatten(move_41.Geometry), Index=0, Wrap=True)
pdecon_6 = Deconstruct(Point=item_11)  # -> XComponent, YComponent, ZComponent
Y_14 = UnitY(Factor=expr("-x", pdecon_6.YComponent))
move_43 = Move(Geometry=move_42.Geometry, Motion=Y_14)  # -> Geometry, Transform
ln_11 = Line(StartPoint=move_42.Geometry, EndPoint=move_43.Geometry)
pframes_4 = PerpFrames(Curve=ln_11, Count=1, Align=True)  # -> Frames, Parameters
item_12 = ListItem(List=pframes_4.Frames, Index=0, Wrap=True)
rectangle_7 = Rectangle(Plane=item_12, XSize=dom_14, YSize=dom_13, Radius=0)  # -> graft(Rectangle), Length
swp1_6 = Sweep1(Rail=ln_11, Sections=rectangle_7.Rectangle, Miter=1)
filter_5 = StreamFilter(Gate=kolom_bovenste_afsluiting, Stream2=swp1_6)

# ----
swp1_7 = Sweep1(Rail=item_9, Sections=rectangle_6.Rectangle, Miter=1)
srf_2 = Surface(rectangle_6.Rectangle)

lng_3 = ListLength(List=flatten(arrbox.Geometry))
lng_4 = ListLength(List=flatten(swp1_7))
division_38 = Division(A=lng_3, B=2)
vloerframe_y_as_aantal = Panel(division_38)
vloerframe_x_as = Panel(lng_4)
preview_2 = CustomPreview(Geometry=[swp1_5, move_40.Geometry, swp1_4, filter_5], Material=ColourSwatch(SwatchColor=RGB(112, 56, 45)))
preview_3 = CustomPreview(Geometry=[arrbox.Geometry, swp1_7, srf_2], Material=ColourSwatch(SwatchColor=RGB(76, 38, 31)))
preview_4 = CustomPreview(Geometry=filter_2, Material=ColourSwatch(SwatchColor=RGB(99, 99, 99)))

item_13 = ListItem(List=flatten(move_20.Geometry), Index=0, Wrap=True)
item_14 = ListItem(List=flatten(move_19.Geometry), Index=0, Wrap=True)
ln_12 = Line(StartPoint=item_14, EndPoint=item_13)
ext_3 = ExtendCurve(Curve=ln_12, Type=0, Start=expr("-X", division_25), End=expr("-X", division_25))
item_15 = ListItem(List=flatten(move_19.Geometry), Index=0, Wrap=True)
item_16 = ListItem(List=flatten(pframes.Frames), Index=0, Wrap=True)  # -> Item2, Item1, Item
pdecon_7 = Deconstruct(Point=item_15)  # -> XComponent, YComponent, ZComponent
pdecon_8 = Deconstruct(Point=item_16.Item2)  # -> XComponent, YComponent, ZComponent
abs_3 = Absolute(Value=pdecon_7.YComponent)
abs_4 = Absolute(Value=pdecon_8.YComponent)
dist_2 = Distance(PointA=item_16.Item2, PointB=item_16.Item)
division_39 = Division(A=dist_2, B="4")
subtraction_13 = Subtraction(A=abs_3, B=abs_4)
multiplication_7 = Multiplication(A=division_39, B=1)
multiplication_8 = Multiplication(A=division_39, B=3)
addition_20 = Addition(A=subtraction_13, B=multiplication_7)
addition_21 = Addition(A=subtraction_13, B=multiplication_8)
Y_15 = UnitY(Factor=addition_20)
Y_16 = UnitY(Factor=addition_21)

item_17 = ListItem(List=flatten(move_19.Geometry), Index=subtraction_2, Wrap=True)
item_18 = ListItem(List=flatten(move_20.Geometry), Index=0, Wrap=True)
move_44 = Move(Geometry=[item_18, item_17], Motion=Z_2)  # -> Geometry, Transform
move_45 = Move(Geometry=move_44.Geometry, Motion=Y)  # -> Geometry, Transform
item_19 = ListItem(List=flatten(move_45.Geometry), Index=0, Wrap=True)  # -> Item, Item1
move_46 = Move(Geometry=item_19.Item1, Motion=X_3)  # -> Geometry, Transform
move_47 = Move(Geometry=item_19.Item, Motion=neg)  # -> Geometry, Transform
pln_2 = Plane(move_47.Geometry)
dist_3 = Distance(PointA=move_47.Geometry, PointB=move_46.Geometry)
subtraction_14 = Subtraction(A=filter, B=kolommen_d, C=vloer_frame_oversteek_straatkant, D=neg_2)
Y_17 = UnitY(Factor=subtraction_14)
move_48 = Move(Geometry=move_47.Geometry, Motion=Y_17)  # -> Geometry, Transform
subtraction_15 = Subtraction(A=dist_3, B=division_5)
move_49 = Move(Geometry=move_48.Geometry, Motion=X_4)  # -> Geometry, Transform
division_40 = Division(A=subtraction_15, B=addition_7)
move_50 = Move(Geometry=[move_47.Geometry, move_48.Geometry], Motion=X_5)  # -> Geometry, Transform
rec_2pt_2 = Rectangle2Pt(Plane=pln_2, PointA=move_47.Geometry, PointB=move_49.Geometry, Radius=0)  # -> Rectangle, Length
move_51 = Move(Geometry=move_50.Geometry, Motion=Z_3)  # -> Geometry, Transform
item_20 = ListItem(List=flatten(move_51.Geometry), Index=0, Wrap=True)  # -> Item, Item1
arrlinear_2 = LinearArray(Geometry=rec_2pt_2.Rectangle, Direction=X_6, Count=division_40)  # -> Geometry, Transform
item_21 = ListItem(List=flatten(arrlinear_2.Geometry), Index="-1", Wrap=True)
cp = ControlPoints(Curve=item_21)  # -> Points, Weights, Knots
item_22 = ListItem(List=flatten(cp.Points), Index="1", Wrap=True)
move_52 = Move(Geometry=item_22, Motion=X_7)  # -> Geometry, Transform
Y_18 = UnitY(Factor=subtraction_14)
pln_3 = Plane(move_52.Geometry)
move_53 = Move(Geometry=move_46.Geometry, Motion=Y_18)  # -> Geometry, Transform
rec_2pt_3 = Rectangle2Pt(Plane=pln_3, PointA=move_52.Geometry, PointB=move_53.Geometry, Radius=0)  # -> Rectangle, Length
wires = BrepWireframe(Brep=rec_2pt_3.Rectangle, Density=-1)
item_23 = ListItem(List=flatten(wires), Index=0, Wrap=True)
len_2 = Length(Curve=item_23)
smaller = SmallerThan(FirstNumber=len_2, SecondNumber="30")  # -> SmallerThan, OrEqualTo
gate = StreamGate(Stream=rec_2pt_3.Rectangle, Gate=smaller.SmallerThan)  # -> Target0, Target1
srf_3 = Surface(gate.Target0)
division_41 = Division(A=len_2, B="2")
addition_22 = Addition(A=dekdelen_tussenruimte, B=division_41, C=division_7)
extr_2 = Extrude(Base=srf_3, Direction=Z_4)

ln_13 = Line(StartPoint=item_20.Item, EndPoint=item_20.Item1)
arrlinear_3 = LinearArray(Geometry=ln_13, Direction=X_6, Count=division_40)  # -> Geometry, Transform

merge_5 = Merge(Data1=arrlinear_3.Geometry)
arrlinear_4 = LinearArray(Geometry=merge_5, Direction=Z_5, Count=x_plus_one_2)  # -> Geometry, Transform
pframes_5 = PerpFrames(Curve=arrlinear_4.Geometry, Count=1, Align=True)  # -> Frames, Parameters
item_24 = ListItem(List=pframes_5.Frames, Index=0, Wrap=True)
item_25 = ListItem(List=flatten(arrlinear_4.Geometry), Index=0, Wrap=True)
rectangle_8 = Rectangle(Plane=item_24, XSize=dom_2, YSize=dom, Radius=0)  # -> Rectangle, Length

item_26 = ListItem(List=flatten(arrlinear_3.Geometry), Index="-1", Wrap=True)
X_21 = UnitX(Factor=addition_22)
move_54 = Move(Geometry=item_26, Motion=X_21)  # -> Geometry, Transform
arrlinear_5 = LinearArray(Geometry=extr_2, Direction=Z_5, Count=x_plus_one_2)  # -> Geometry, Transform
arrlinear_6 = LinearArray(Geometry=move_54.Geometry, Direction=Z_5, Count=x_plus_one_2)  # -> Geometry, Transform

swp1_8 = Sweep1(Rail=item_25, Sections=rectangle_8.Rectangle, Miter=1)
srf_4 = Surface(rectangle_8.Rectangle)

lng_5 = ListLength(List=flatten(swp1_8))
dekdelen_aantal = Panel(lng_5)
preview_5 = CustomPreview(Geometry=[swp1_8, srf_4, arrlinear_6.Geometry, arrlinear_5.Geometry], Material=ColourSwatch(SwatchColor=RGB(79, 60, 57)))

move_55 = Move(Geometry=ext_3, Motion=Y_15)  # -> Geometry, Transform
move_56 = Move(Geometry=ext_3, Motion=Y_16)  # -> Geometry, Transform
move_57 = Move(Geometry=move_56.Geometry, Motion=X_18)  # -> Geometry, Transform
move_58 = Move(Geometry=move_55.Geometry, Motion=X_19)  # -> Geometry, Transform
merge_6 = Merge(Data1=move_55.Geometry, Data2=move_56.Geometry, Data3=move_58.Geometry, Data4=move_57.Geometry)

rectangle_9 = Rectangle(Plane=[move_55.Geometry, move_56.Geometry, move_58.Geometry, move_57.Geometry], XSize=dom_10, YSize=dom_9, Radius=0)  # -> Rectangle, Length
swp1_9 = Sweep1(Rail=move_55.Geometry, Sections=graft(rectangle_9.Rectangle), Miter=1)

arrbox_2 = BoxArray(Geometry=[swp1_9, merge_6], Cell=box, XCount=subtraction_5, YCount=1, ZCount=addition_12)  # -> Geometry, Transform

preview_6 = CustomPreview(Geometry=[arrlinear.Geometry, arrbox_2.Geometry], Material=ColourSwatch(SwatchColor=RGB(145, 113, 106)))

ln_14 = Line(StartPoint=move_9.Geometry, EndPoint=move_10.Geometry)

move_59 = Move(Geometry=[ln_14, rectangle.Rectangle], Motion=Z_15)  # -> Geometry, Transform
item_27 = ListItem(List=[ln_14, rectangle.Rectangle], Index=0, Wrap=True)  # -> Item, Item1

item_28 = ListItem(List=move_59.Geometry, Index=0, Wrap=True)  # -> Item, Item1

swp1_10 = Sweep1(Rail=[item_27.Item, item_28.Item], Sections=graft([item_27.Item1, item_28.Item1]), Miter=1)
arrrec_3 = RectangularArray(Geometry=[swp1_10, ln_14, item_28.Item], Cell=rec_2pt.Rectangle, XCount=subtraction_5, YCount=addition_12)  # -> Geometry, Transform

lng_6 = ListLength(List=flatten(arrrec_3.Geometry))
division_42 = Division(A=lng_6, B=3)
balustradebalken_aantal = Panel(division_42)
preview_7 = CustomPreview(Geometry=[swp1, arrrec_3.Geometry], Material=ColourSwatch(SwatchColor=RGB(87, 32, 21)))
