# Grasshopper definition lijntest.ghx (Grasshopper 1.0.7)

number_slider = Slider(10000, range=0..10000)
number_slider_2 = Slider(1000, range=0..10000)
pt = ConstructPoint(XCoordinate="0", YCoordinate=number_slider, ZCoordinate="0")
pt_2 = ConstructPoint(XCoordinate="0", YCoordinate="0", ZCoordinate="0")
pt_3 = ConstructPoint(XCoordinate="0", YCoordinate="0", ZCoordinate=number_slider_2)
pt_4 = ConstructPoint(XCoordinate="0", YCoordinate=number_slider, ZCoordinate=number_slider_2)
pt_5 = ConstructPoint(XCoordinate="0", YCoordinate=Slider(5000, range=0..10000), ZCoordinate=Slider(2000, range=0..10000))
arc = Arc3Pt(PointA=pt_3, PointB=pt_5, PointC=pt_4)  # -> Arc, Plane, Radius
ln = Line(StartPoint=pt_2, EndPoint=pt)
rulesrf = RuledSurface(CurveA=arc.Arc, CurveB=ln)
