# Grasshopper definition lijntest2.ghx (Grasshopper 1.0.7)

pt = ConstructPoint(XCoordinate=Slider(0, range=0..100000), YCoordinate=Slider(0, range=0..100000), ZCoordinate=Slider(0, range=0..100000))
pt_2 = ConstructPoint(
    XCoordinate=Slider(1000, range=0..100000),
    YCoordinate=Slider(0, range=0..100000),
    ZCoordinate=Slider(0, range=0..100000))
ln = Line(StartPoint=pt, EndPoint=pt_2)
