# Grasshopper definition lofttest.ghx (Grasshopper 1.0.7)

number_slider = Slider(1000, range=0..1000)
neg = Negative(Value=number_slider)
neg_2 = Negative(Value=number_slider)
dom = ConstructDomain(DomainStart=number_slider, DomainEnd=neg)
dom_2 = ConstructDomain(DomainStart=number_slider, DomainEnd=neg_2)
rectangle = Rectangle(Plane=PlaneXY(0, 0, 0), XSize=dom_2, YSize=dom, Radius=0)  # -> Rectangle, Length
Z = UnitZ(Factor=number_slider)
move = Move(Geometry=rectangle.Rectangle, Motion=Z)  # -> Geometry, Transform
loft = Loft(
    Curves=[rectangle.Rectangle, move.Geometry],
    Options={Adjust=False, Closed=False, LoftEnds=0, LoftSimp=0, LoftType=0, Rebuild=10, Refit=0.01})
cap = CapHoles(Brep=loft)
