# Grasshopper definition surfacetest.ghx (Grasshopper 1.0.7)

number_slider = Slider(1000, range=0..100000)
neg = Negative(Value=number_slider)
xy = XYPlane(Origin=Point(0, 0, 0))
dom = ConstructDomain(DomainStart=number_slider, DomainEnd=neg)
rectangle = Rectangle(Plane=xy, XSize=dom, YSize=dom, Radius=Slider(100, range=0..100000))  # -> Rectangle, Length
srf = Surface(rectangle.Rectangle)
