# Grasshopper definition test_curve_primitives.ghx (Grasshopper 1.0.8)

list = ValueList({"500": 0, "800": 1, "1000": 2}, selected="1000")
number_slider = Slider(0, range=0..100000)
number_slider_2 = Slider(500, range=0..100000)
number_slider_3 = Slider(1000, range=0..100000)
panel = Panel("0")
filter = StreamFilter(Gate=list, Stream0="500", Stream1="800", Stream2="1000")
pt = ConstructPoint(XCoordinate=number_slider, YCoordinate=number_slider, ZCoordinate=number_slider_3)
pt_2 = ConstructPoint(XCoordinate=filter, YCoordinate=filter, ZCoordinate=number_slider_3)
pt_3 = ConstructPoint(XCoordinate=filter, YCoordinate=number_slider, ZCoordinate=number_slider_3)
xy = XYPlane(Origin=pt)
rec_2pt = Rectangle2Pt(Plane=xy, PointA=pt, PointB=pt_2, Radius=Slider(100, range=0..100000))  # -> Rectangle, Length
rec_3pt = Rectangle3Pt(PointA=pt, PointB=pt_2, PointC=pt_3)  # -> Rectangle, Length
series = Series(Start="0", Step="2000", Count="10")
series_2 = Series(Start="-1", Step="-1", Count=Slider(3, range=0..10))
srf = Surface(rec_2pt.Rectangle)
cull_i = CullIndex(List=series, Indices=series_2, Wrap=True)
X = UnitX(Factor=cull_i)
move = Move(Geometry=srf, Motion=X)  # -> Geometry, Transform
