# Grasshopper definition test_loft.ghx (Grasshopper 1.0.8)

series = Series(Start="1000", Step="1000", Count=10)
pt = ConstructPoint(XCoordinate="0", YCoordinate="0", ZCoordinate="1000")
X = UnitX(Factor=series)
move = Move(Geometry=pt, Motion=X)  # -> Geometry, Transform
Y = UnitY(Factor="1000")
move_2 = Move(Geometry=move.Geometry, Motion=Y)  # -> Geometry, Transform
cir = Circle(Plane=move_2.Geometry, Radius="250")  # -> graft(Circle)
Z = UnitZ(Factor="2500")
cir_2 = Circle(Plane=pt, Radius="250")
Z_2 = UnitZ(Factor="2500")
move_3 = Move(Geometry=cir_2, Motion=Z_2)  # -> Geometry, Transform
move_4 = Move(Geometry=cir, Motion=Z)  # -> Geometry, Transform
loft = Loft(
    Curves=[cir_2, move_3.Geometry],
    Options={Adjust=False, Closed=False, LoftEnds=0, LoftSimp=0, LoftType=0, Rebuild=10, Refit=0.01})
loft_2 = Loft(
    Curves=[cir, move_4.Geometry],
    Options={Adjust=False, Closed=False, LoftEnds=0, LoftSimp=0, LoftType=0, Rebuild=10, Refit=0.01})
