# Grasshopper definition test_loft_nurbs.ghx (Grasshopper 1.0.8)

pt = ConstructPoint(XCoordinate="0", YCoordinate="0", ZCoordinate="0")
pt_2 = ConstructPoint(XCoordinate="0", YCoordinate="0", ZCoordinate="1000")
pt_3 = ConstructPoint(XCoordinate="500", YCoordinate="500", ZCoordinate="0")
pt_4 = ConstructPoint(XCoordinate="1000", YCoordinate="0", ZCoordinate="0")
pt_5 = ConstructPoint(XCoordinate="500", YCoordinate="1000", ZCoordinate="1000")
pt_6 = ConstructPoint(XCoordinate="1000", YCoordinate="0", ZCoordinate="1000")
pt_7 = ConstructPoint(XCoordinate="0", YCoordinate="0", ZCoordinate="2000")
pt_8 = ConstructPoint(XCoordinate="500", YCoordinate="250", ZCoordinate="2000")
pt_9 = ConstructPoint(XCoordinate="200", YCoordinate="0", ZCoordinate="3000")
pt_10 = ConstructPoint(XCoordinate="1000", YCoordinate="0", ZCoordinate="2000")
pt_11 = ConstructPoint(XCoordinate="500", YCoordinate="100", ZCoordinate="3000")
pt_12 = ConstructPoint(XCoordinate="800", YCoordinate="0", ZCoordinate="3000")
arc = Arc3Pt(PointA=pt, PointB=pt_3, PointC=pt_4)  # -> Arc, Plane, Radius
arc_2 = Arc3Pt(PointA=pt_2, PointB=pt_5, PointC=pt_6)  # -> Arc, Plane, Radius
arc_3 = Arc3Pt(PointA=pt_7, PointB=pt_8, PointC=pt_10)  # -> Arc, Plane, Radius
arc_4 = Arc3Pt(PointA=pt_9, PointB=pt_11, PointC=pt_12)  # -> Arc, Plane, Radius
loft = Loft(
    Curves=[arc.Arc, arc_2.Arc, arc_3.Arc, arc_4.Arc],
    Options={Adjust=False, Closed=False, LoftEnds=0, LoftSimp=0, LoftType=0, Rebuild=10, Refit=0.01})
