# Grasshopper definition test_rectangle.ghx (Grasshopper 1.0.8)

series = Series(Start="1000", Step="1000", Count=10)
pt = ConstructPoint(XCoordinate="0", YCoordinate="0", ZCoordinate="2500")
pt_2 = ConstructPoint(XCoordinate="0", YCoordinate="0", ZCoordinate="1000")
X = UnitX(Factor=series)
ln = Line(StartPoint=pt_2, EndPoint=pt)
move = Move(Geometry=pt_2, Motion=X)  # -> Geometry, Transform
Y = UnitY(Factor="1000")
neg = Negative(Value="250")
move_2 = Move(Geometry=move.Geometry, Motion=Y)  # -> Geometry, Transform
xy = XYPlane(Origin=move.Geometry)
dom = ConstructDomain(DomainStart=neg, DomainEnd="250")
xy_2 = XYPlane(Origin=move_2.Geometry)
cir = Circle(Plane=pt_2, Radius="250")
cir_2 = Circle(Plane=move_2.Geometry, Radius="250")
rectangle = Rectangle(Plane=move.Geometry, XSize=dom, YSize=dom, Radius=0)  # -> Rectangle, Length
swp1 = Sweep1(Rail=ln, Sections=cir, Miter=1)
swp1_2 = Sweep1(Rail=ln, Sections=graft(rectangle.Rectangle), Miter=1)
swp1_3 = Sweep1(Rail=ln, Sections=graft(cir_2), Miter=1)
