# Grasshopper definition brugtest.ghx (Grasshopper 1.0.7)

breedte = Slider(2000, range=1000..6000)
lengte = Slider(10000, range=3000..25000)
toog = Slider(200, range=100..1000)
division = Division(A=breedte, B="2")
neg = Negative(Value=division)
division_2 = Division(A=lengte, B="55")
pt = ConstructPoint(XCoordinate="0", YCoordinate="0", ZCoordinate="0")
pt_2 = ConstructPoint(XCoordinate=lengte, YCoordinate="0", ZCoordinate="0")
pt_3 = ConstructPoint(XCoordinate="0", YCoordinate=neg, ZCoordinate="0")
pt_4 = ConstructPoint(XCoordinate="0", YCoordinate=division, ZCoordinate="0")
neg_2 = Negative(Value=division_2)
Z = UnitZ(Factor=neg_2)
ln = Line(StartPoint=pt_3, EndPoint=pt_4)
ln_2 = Line(StartPoint=pt, EndPoint=pt_2)
move = Move(Geometry=ln, Motion=Z)  # -> Geometry, Transform
midpt = CurveMiddle(Curve=ln_2)
Z_2 = UnitZ(Factor=toog)
rulesrf = RuledSurface(CurveA=ln, CurveB=move.Geometry)
move_2 = Move(Geometry=midpt, Motion=Z_2)  # -> Geometry, Transform
arc = Arc3Pt(PointA=pt, PointB=move_2.Geometry, PointC=pt_2)  # -> Arc, Plane, Radius
swp1 = Sweep1(Rail=arc.Arc, Sections=rulesrf, Miter=1)
