# Grasshopper definition test3.ghx (Grasshopper 1.0.7)

pt = ConstructPoint(XCoordinate=0, YCoordinate=0, ZCoordinate=0)
cyl = Cylinder(Base=pt, Radius=Slider(500, range=100..2000), Length=Slider(500, range=100..2000))
