# Grasshopper definition test4.ghx (Grasshopper 1.0.7)

breedte = Slider(2500, range=1000..6500)
lengte = Slider(12000, range=4000..26000)
division = Division(A=lengte, B="2")
division_2 = Division(A=breedte, B="2")
toog = Slider(200, range=100..1000)
neg = Negative(Value=division)
subtraction = Subtraction(A=division_2, B="150")
neg_2 = Negative(Value=subtraction)
division_3 = Division(A=neg_2, B="1")
subtraction_2 = Subtraction(A=neg_2, B="150")
addition = Addition(A=neg_2, B="150")
subtraction_3 = Subtraction(A="0", B="25")
subtraction_4 = Subtraction(A="0", B="25")
division_4 = Division(A=lengte, B="2")
division_5 = Division(A=lengte, B="50")
division_6 = Division(A=lengte, B="2")
division_7 = Division(A=lengte, B="50")
addition_2 = Addition(A=subtraction_3, B=toog)
addition_3 = Addition(A="25", B=division_5)
addition_4 = Addition(A=subtraction_4, B=toog)
addition_5 = Addition(A="25", B=division_7)
subtraction_5 = Subtraction(A=toog, B=addition_3)
subtraction_6 = Subtraction(A=subtraction, B=division_5)
pt = ConstructPoint(XCoordinate=neg, YCoordinate=subtraction, ZCoordinate=subtraction_3)
pt_2 = ConstructPoint(XCoordinate=neg, YCoordinate=division_2, ZCoordinate="0")
pt_3 = ConstructPoint(XCoordinate="0", YCoordinate=subtraction, ZCoordinate=addition_2)
pt_4 = ConstructPoint(XCoordinate="0", YCoordinate=division_2, ZCoordinate=toog)
pt_5 = ConstructPoint(XCoordinate=division, YCoordinate=subtraction, ZCoordinate=subtraction_3)
pt_6 = ConstructPoint(XCoordinate=division, YCoordinate=division_2, ZCoordinate="0")
pt_7 = ConstructPoint(XCoordinate=neg, YCoordinate=division_2, ZCoordinate=subtraction_3)
pt_8 = ConstructPoint(XCoordinate="0", YCoordinate=division_2, ZCoordinate=addition_2)
pt_9 = ConstructPoint(XCoordinate=division, YCoordinate=division_2, ZCoordinate=subtraction_3)
subtraction_7 = Subtraction(A=toog, B=addition_5)
subtraction_8 = Subtraction(A=addition, B=division_7)
addition_6 = Addition(A=neg_2, B=division_7)
pt_10 = ConstructPoint(XCoordinate=neg, YCoordinate=neg_2, ZCoordinate=subtraction_4)
pt_11 = ConstructPoint(XCoordinate="0", YCoordinate=neg_2, ZCoordinate=addition_4)
pt_12 = ConstructPoint(XCoordinate=division, YCoordinate=neg_2, ZCoordinate=subtraction_4)
neg_3 = Negative(Value=addition_3)
neg_4 = Negative(Value=addition_5)
pt_13 = ConstructPoint(XCoordinate=neg, YCoordinate=subtraction_2, ZCoordinate=subtraction_4)
pt_14 = ConstructPoint(XCoordinate="0", YCoordinate=subtraction_2, ZCoordinate=addition_4)
pt_15 = ConstructPoint(XCoordinate=neg, YCoordinate=subtraction_2, ZCoordinate="0")
pt_16 = ConstructPoint(XCoordinate=division, YCoordinate=subtraction_2, ZCoordinate=subtraction_4)
pt_17 = ConstructPoint(XCoordinate="0", YCoordinate=subtraction_2, ZCoordinate=toog)
pt_18 = ConstructPoint(XCoordinate=division, YCoordinate=subtraction_2, ZCoordinate="0")
arc = Arc3Pt(PointA=pt, PointB=pt_3, PointC=pt_5)  # -> Arc, Plane, Radius
arc_2 = Arc3Pt(PointA=pt_2, PointB=pt_4, PointC=pt_6)  # -> Arc, Plane, Radius
arc_3 = Arc3Pt(PointA=pt_7, PointB=pt_8, PointC=pt_9)  # -> Arc, Plane, Radius
arc_4 = Arc3Pt(PointA=pt_10, PointB=pt_11, PointC=pt_12)  # -> Arc, Plane, Radius
pt_19 = ConstructPoint(XCoordinate=neg, YCoordinate=subtraction_6, ZCoordinate=neg_3)
pt_20 = ConstructPoint(XCoordinate="0", YCoordinate=subtraction_6, ZCoordinate=subtraction_5)
pt_21 = ConstructPoint(XCoordinate=division, YCoordinate=subtraction_6, ZCoordinate=neg_3)
pt_22 = ConstructPoint(XCoordinate=neg, YCoordinate=addition_6, ZCoordinate=neg_4)
pt_23 = ConstructPoint(XCoordinate="0", YCoordinate=addition_6, ZCoordinate=subtraction_7)
pt_24 = ConstructPoint(XCoordinate=division, YCoordinate=addition_6, ZCoordinate=neg_4)
arc_5 = Arc3Pt(PointA=pt_13, PointB=pt_14, PointC=pt_16)  # -> Arc, Plane, Radius
arc_6 = Arc3Pt(PointA=pt_15, PointB=pt_17, PointC=pt_18)  # -> Arc, Plane, Radius
arc_7 = Arc3Pt(PointA=pt_19, PointB=pt_20, PointC=pt_21)  # -> Arc, Plane, Radius
rulesrf = RuledSurface(CurveA=arc_5.Arc, CurveB=arc_4.Arc)
rulesrf_2 = RuledSurface(CurveA=arc_3.Arc, CurveB=arc_2.Arc)
rulesrf_3 = RuledSurface(CurveA=arc_6.Arc, CurveB=arc_5.Arc)
rulesrf_4 = RuledSurface(CurveA=arc.Arc, CurveB=arc_3.Arc)
rulesrf_5 = RuledSurface(CurveA=arc_7.Arc, CurveB=arc.Arc)
neg_5 = Negative(Value=division)
arc_8 = Arc3Pt(PointA=pt_22, PointB=pt_23, PointC=pt_24)  # -> Arc, Plane, Radius
rulesrf_6 = RuledSurface(CurveA=arc_4.Arc, CurveB=arc_8.Arc)
rulesrf_7 = RuledSurface(CurveA=arc_8.Arc, CurveB=arc_7.Arc)
neg_6 = Negative(Value="-30000")
neg_7 = Negative(Value=subtraction)
pt_25 = ConstructPoint(XCoordinate=neg_5, YCoordinate="-30000", ZCoordinate="-1000")
pt_26 = ConstructPoint(XCoordinate=neg_5, YCoordinate=subtraction, ZCoordinate="-1000")
pt_27 = ConstructPoint(XCoordinate=division, YCoordinate="30000", ZCoordinate="-1000")
pt_28 = ConstructPoint(XCoordinate=division, YCoordinate=subtraction, ZCoordinate="-1000")
pt_29 = ConstructPoint(XCoordinate=neg_5, YCoordinate=neg_7, ZCoordinate="-1000")
pt_30 = ConstructPoint(XCoordinate=neg_5, YCoordinate="-30000", ZCoordinate="0")
pt_31 = ConstructPoint(XCoordinate=neg_5, YCoordinate=subtraction, ZCoordinate="0")
neg_8 = Negative(Value="30000")
pt_32 = ConstructPoint(XCoordinate=neg_5, YCoordinate=neg_6, ZCoordinate="-1000")
neg_9 = Negative(Value=subtraction)
pt_33 = ConstructPoint(XCoordinate=division, YCoordinate=neg_9, ZCoordinate="-1000")
pt_34 = ConstructPoint(XCoordinate=neg_5, YCoordinate=neg_7, ZCoordinate="0")
pt_35 = ConstructPoint(XCoordinate=division, YCoordinate=neg_8, ZCoordinate="-1000")
X = UnitX(Factor="-30000")
X_2 = UnitX(Factor="1000")
pt_36 = ConstructPoint(XCoordinate=neg_5, YCoordinate=neg_6, ZCoordinate="0")
X_3 = UnitX(Factor="-1000")
pt_37 = ConstructPoint(XCoordinate=division, YCoordinate="30000", ZCoordinate="0")
pt_38 = ConstructPoint(XCoordinate=division, YCoordinate=subtraction, ZCoordinate="0")
move = Move(Geometry=pt_25, Motion=X_2)  # -> Geometry, Transform
move_2 = Move(Geometry=pt_26, Motion=X_2)  # -> Geometry, Transform
move_3 = Move(Geometry=pt_32, Motion=X_2)  # -> Geometry, Transform
move_4 = Move(Geometry=pt_29, Motion=X_2)  # -> Geometry, Transform
pt_39 = ConstructPoint(XCoordinate=division, YCoordinate=neg_9, ZCoordinate="0")
X_4 = UnitX(Factor="30000")
move_5 = Move(Geometry=pt_30, Motion=X)  # -> Geometry, Transform
pt_40 = ConstructPoint(XCoordinate=division, YCoordinate=neg_8, ZCoordinate="0")
move_6 = Move(Geometry=pt_31, Motion=X)  # -> Geometry, Transform
move_7 = Move(Geometry=pt_34, Motion=X)  # -> Geometry, Transform
move_8 = Move(Geometry=pt_27, Motion=X_3)  # -> Geometry, Transform
move_9 = Move(Geometry=pt_35, Motion=X_3)  # -> Geometry, Transform
move_10 = Move(Geometry=pt_28, Motion=X_3)  # -> Geometry, Transform
move_11 = Move(Geometry=pt_33, Motion=X_3)  # -> Geometry, Transform
move_12 = Move(Geometry=pt_36, Motion=X)  # -> Geometry, Transform
neg_10 = Negative(Value="1000")
rulesrf_8 = RuledSurface(CurveA=arc_2.Arc, CurveB=arc_6.Arc)
move_13 = Move(Geometry=pt_37, Motion=X_4)  # -> Geometry, Transform
move_14 = Move(Geometry=pt_38, Motion=X_4)  # -> Geometry, Transform
move_15 = Move(Geometry=pt_39, Motion=X_4)  # -> Geometry, Transform
Y = UnitY(Factor="1000")
Y_2 = UnitY(Factor=neg_10)
ln = Line(StartPoint=pt_30, EndPoint=move.Geometry)
ln_2 = Line(StartPoint=pt_31, EndPoint=move_2.Geometry)
ln_3 = Line(StartPoint=pt_34, EndPoint=move_4.Geometry)
ln_4 = Line(StartPoint=pt_36, EndPoint=move_3.Geometry)
neg_11 = Negative(Value="1000")
ln_5 = Line(StartPoint=pt_34, EndPoint=move_7.Geometry)
move_16 = Move(Geometry=pt_40, Motion=X_4)  # -> Geometry, Transform
ln_6 = Line(StartPoint=pt_30, EndPoint=move_5.Geometry)
ln_7 = Line(StartPoint=pt_31, EndPoint=move_6.Geometry)
ln_8 = Line(StartPoint=pt_40, EndPoint=move_9.Geometry)
ln_9 = Line(StartPoint=pt_38, EndPoint=move_10.Geometry)
ln_10 = Line(StartPoint=pt_37, EndPoint=move_8.Geometry)
ln_11 = Line(StartPoint=pt_39, EndPoint=move_11.Geometry)
ln_12 = Line(StartPoint=move_8.Geometry, EndPoint=move_9.Geometry)
ln_13 = Line(StartPoint=pt_36, EndPoint=move_12.Geometry)
Y_3 = UnitY(Factor=neg_11)
Y_4 = UnitY(Factor="1000")
ln_14 = Line(StartPoint=move.Geometry, EndPoint=move_3.Geometry)
move_17 = Move(Geometry=ln_3, Motion=Y_2)  # -> Geometry, Transform
move_18 = Move(Geometry=ln_2, Motion=Y)  # -> Geometry, Transform
Z = UnitZ(Factor="50")
ln_15 = Line(StartPoint=pt_39, EndPoint=move_15.Geometry)
ln_16 = Line(StartPoint=pt_37, EndPoint=move_13.Geometry)
rulesrf_9 = RuledSurface(CurveA=ln_5, CurveB=ln_7)
ln_17 = Line(StartPoint=pt_38, EndPoint=move_14.Geometry)
rulesrf_10 = RuledSurface(CurveA=ln_7, CurveB=ln_13)
Z_2 = UnitZ(Factor="50")
rulesrf_11 = RuledSurface(CurveA=ln_6, CurveB=ln_5)
ln_18 = Line(StartPoint=pt_40, EndPoint=move_16.Geometry)
move_19 = Move(Geometry=ln_9, Motion=Y_4)  # -> Geometry, Transform
move_20 = Move(Geometry=ln_11, Motion=Y_3)  # -> Geometry, Transform
rulesrf_12 = RuledSurface(CurveA=move_17.Geometry, CurveB=ln)
rulesrf_13 = RuledSurface(CurveA=ln_4, CurveB=move_18.Geometry)
move_21 = Move(Geometry=ln_12, Motion=Z)  # -> Geometry, Transform
rulesrf_14 = RuledSurface(CurveA=move_18.Geometry, CurveB=move_17.Geometry)
rulesrf_15 = RuledSurface(CurveA=ln_17, CurveB=ln_15)
X_5 = UnitX(Factor="-40")
rulesrf_16 = RuledSurface(CurveA=ln_15, CurveB=ln_18)
move_22 = Move(Geometry=ln_14, Motion=Z_2)  # -> Geometry, Transform
rulesrf_17 = RuledSurface(CurveA=ln_16, CurveB=ln_17)
Z_3 = UnitZ(Factor="-100")
X_6 = UnitX(Factor="40")
Z_4 = UnitZ(Factor="-100")
move_23 = Move(Geometry=move_21.Geometry, Motion=X_5)  # -> Geometry, Transform
move_24 = Move(Geometry=move_22.Geometry, Motion=X_6)  # -> Geometry, Transform
rulesrf_18 = RuledSurface(CurveA=ln_8, CurveB=move_20.Geometry)
rulesrf_19 = RuledSurface(CurveA=move_19.Geometry, CurveB=ln_10)
rulesrf_20 = RuledSurface(CurveA=move_20.Geometry, CurveB=move_19.Geometry)
move_25 = Move(Geometry=move_23.Geometry, Motion=Z_3)  # -> Geometry, Transform
material = CreateMaterial(Diffuse="56;62;66", Specular="255;255;255", Emission="0;0;0", Transparency="0", Shine="0")
material_2 = CreateMaterial(Diffuse="220;220;220", Specular="255;255;255", Emission="0;0;0", Transparency="0", Shine="0")
move_26 = Move(Geometry=move_24.Geometry, Motion=Z_4)  # -> Geometry, Transform
material_3 = CreateMaterial(Diffuse="210;210;210", Specular="255;255;255", Emission="0;0;0", Transparency="0", Shine="0")
material_4 = CreateMaterial(Diffuse="124;252;0", Specular="255;255;255", Emission="0;0;0", Transparency="0", Shine="0")
rulesrf_21 = RuledSurface(CurveA=ln_12, CurveB=move_21.Geometry)
rulesrf_22 = RuledSurface(CurveA=move_23.Geometry, CurveB=move_25.Geometry)
rulesrf_23 = RuledSurface(CurveA=move_21.Geometry, CurveB=move_23.Geometry)
preview = CustomPreview(Geometry=[rulesrf_2, rulesrf_4, rulesrf_5, rulesrf_7, rulesrf_6, rulesrf, rulesrf_3], Material=material)
preview_2 = CustomPreview(Geometry=rulesrf_8, Material=material_2)
rulesrf_24 = RuledSurface(CurveA=ln_14, CurveB=move_22.Geometry)
rulesrf_25 = RuledSurface(CurveA=move_24.Geometry, CurveB=move_26.Geometry)
rulesrf_26 = RuledSurface(CurveA=move_22.Geometry, CurveB=move_24.Geometry)
flip = FlipCurve(Curve=move_25.Geometry)  # -> Curve, Flag
flip_2 = Flip(Surface=rulesrf_22)  # -> Surface, Result
flip_3 = Flip(Surface=rulesrf_21)  # -> Surface, Result
flip_4 = Flip(Surface=rulesrf_23)  # -> Surface, Result
preview_3 = CustomPreview(Geometry=rulesrf_9, Material=material_3)
preview_4 = CustomPreview(Geometry=[rulesrf_11, rulesrf_10, rulesrf_12, rulesrf_13], Material=material_4)
material_5 = CreateMaterial(Diffuse="210;210;210", Specular="255;255;255", Emission="0;0;0", Transparency="0", Shine="0")
material_6 = CreateMaterial(Diffuse="124;252;0", Specular="255;255;255", Emission="0;0;0", Transparency="0", Shine="0")
rulesrf_27 = RuledSurface(CurveA=move_26.Geometry, CurveB=flip.Curve)
material_7 = CreateMaterial(Diffuse="180;180;180", Specular="255;255;255", Emission="0;0;0", Transparency="0", Shine="0")
preview_5 = CustomPreview(Geometry=rulesrf_15, Material=material_5)
preview_6 = CustomPreview(Geometry=[rulesrf_17, rulesrf_16, rulesrf_19, rulesrf_18], Material=material_6)
material_8 = CreateMaterial(Diffuse="180;180;180", Specular="255;255;255", Emission="0;0;0", Transparency="0", Shine="0")
material_9 = CreateMaterial(Diffuse="99;73;43", Specular="255;255;255", Emission="0;0;0", Transparency="0", Shine="0")
material_10 = CreateMaterial(Diffuse="99;73;43", Specular="255;255;255", Emission="0;0;0", Transparency="0", Shine="0")
preview_7 = CustomPreview(Geometry=rulesrf_14, Material=material_7)
preview_8 = CustomPreview(Geometry=rulesrf_20, Material=material_8)
material_11 = CreateMaterial(Diffuse="201;233;245", Specular="255;255;255", Emission="0;0;0", Transparency="0", Shine="0")
preview_9 = CustomPreview(Geometry=[flip_3.Surface, flip_4.Surface, flip_2.Surface], Material=material_9)
preview_10 = CustomPreview(Geometry=[rulesrf_24, rulesrf_26, rulesrf_25], Material=material_10)
preview_11 = CustomPreview(Geometry=rulesrf_27, Material=material_11)
neg_12 = Negative(Value="70")
neg_13 = Negative(Value="50")
Y_5 = UnitY(Factor=neg_12)
neg_14 = Negative(Value="200")
Y_6 = UnitY(Factor=neg_13)
move_27 = Move(Geometry=arc_2.Arc, Motion=Y_5)  # -> Geometry, Transform
Y_7 = UnitY(Factor="50")
ext = ExtendCurve(Curve=move_27.Geometry, Type=0, Start=neg_14, End=neg_14)
move_28 = Move(Geometry=move_27.Geometry, Motion=Y_6)  # -> Geometry, Transform
move_29 = Move(Geometry=move_27.Geometry, Motion=Y_7)  # -> Geometry, Transform
Z_5 = UnitZ(Factor="12")
neg_15 = Negative(Value="40")
Z_6 = UnitZ(Factor="988")
len = Length(Curve=ext)
neg_16 = Negative(Value="40")
Y_8 = UnitY(Factor="70")
Z_7 = UnitZ(Factor="500")
neg_17 = Negative(Value="200")
Y_9 = UnitY(Factor=neg_15)
move_30 = Move(Geometry=move_29.Geometry, Motion=Z_5)  # -> Geometry, Transform
move_31 = Move(Geometry=move_28.Geometry, Motion=Z_5)  # -> Geometry, Transform
move_32 = Move(Geometry=arc_6.Arc, Motion=Y_8)  # -> Geometry, Transform
Y_10 = UnitY(Factor="40")
move_33 = Move(Geometry=move_27.Geometry, Motion=Z_6)  # -> Geometry, Transform
Y_11 = UnitY(Factor=neg_16)
Y_12 = UnitY(Factor="40")
division_8 = Division(A=len, B="1500")
move_34 = Move(Geometry=move_27.Geometry, Motion=Z_7)  # -> Geometry, Transform
ext_2 = ExtendCurve(Curve=move_32.Geometry, Type=0, Start=neg_17, End=neg_17)
move_35 = Move(Geometry=move_33.Geometry, Motion=Y_9)  # -> Geometry, Transform
move_36 = Move(Geometry=move_33.Geometry, Motion=Y_10)  # -> Geometry, Transform
rulesrf_28 = RuledSurface(CurveA=move_28.Geometry, CurveB=move_29.Geometry)
rulesrf_29 = RuledSurface(CurveA=move_30.Geometry, CurveB=move_31.Geometry)
rulesrf_30 = RuledSurface(CurveA=move_31.Geometry, CurveB=move_28.Geometry)
round = Round(Number=division_8)  # -> Nearest, Floor, Ceiling
rulesrf_31 = RuledSurface(CurveA=move_29.Geometry, CurveB=move_30.Geometry)
neg_18 = Negative(Value="50")
move_37 = Move(Geometry=move_34.Geometry, Motion=Y_11)  # -> Geometry, Transform
Z_8 = UnitZ(Factor="12")
move_38 = Move(Geometry=move_34.Geometry, Motion=Y_12)  # -> Geometry, Transform
Z_9 = UnitZ(Factor="12")
len_2 = Length(Curve=ext_2)
neg_19 = Negative(Value="12")
neg_20 = Negative(Value="12")
Y_13 = UnitY(Factor=neg_18)
neg_21 = Negative(Value="40")
neg_22 = Negative(Value="40")
Y_14 = UnitY(Factor="50")
move_39 = Move(Geometry=move_36.Geometry, Motion=Z_8)  # -> Geometry, Transform
move_40 = Move(Geometry=move_35.Geometry, Motion=Z_8)  # -> Geometry, Transform
Z_10 = UnitZ(Factor="988")
divide = DivideCurve(Curve=ext, Count=round.Nearest, Kinks=False)  # -> Points, Tangents, Parameters
Z_11 = UnitZ(Factor="500")
move_41 = Move(Geometry=move_38.Geometry, Motion=Z_9)  # -> Geometry, Transform
move_42 = Move(Geometry=move_37.Geometry, Motion=Z_9)  # -> Geometry, Transform
division_9 = Division(A=len_2, B="1500")
ext_3 = ExtendCurve(Curve=move_36.Geometry, Type=0, Start=neg_19, End=neg_19)
ext_4 = ExtendCurve(Curve=move_35.Geometry, Type=0, Start=neg_19, End=neg_19)
ext_5 = ExtendCurve(Curve=move_41.Geometry, Type=0, Start=neg_20, End=neg_20)
ext_6 = ExtendCurve(Curve=move_42.Geometry, Type=0, Start=neg_20, End=neg_20)
Y_15 = UnitY(Factor=neg_21)
Y_16 = UnitY(Factor=neg_22)
move_43 = Move(Geometry=move_32.Geometry, Motion=Y_13)  # -> Geometry, Transform
Y_17 = UnitY(Factor="40")
move_44 = Move(Geometry=move_32.Geometry, Motion=Z_10)  # -> Geometry, Transform
move_45 = Move(Geometry=move_32.Geometry, Motion=Y_14)  # -> Geometry, Transform
Y_18 = UnitY(Factor="40")
move_46 = Move(Geometry=move_32.Geometry, Motion=Z_11)  # -> Geometry, Transform
rulesrf_32 = RuledSurface(CurveA=move_35.Geometry, CurveB=move_36.Geometry)
rulesrf_33 = RuledSurface(CurveA=move_39.Geometry, CurveB=move_40.Geometry)
rulesrf_34 = RuledSurface(CurveA=move_40.Geometry, CurveB=move_35.Geometry)
rulesrf_35 = RuledSurface(CurveA=move_36.Geometry, CurveB=move_39.Geometry)
round_2 = Round(Number=division_9)  # -> Nearest, Floor, Ceiling
Z_12 = UnitZ(Factor="12")
rulesrf_36 = RuledSurface(CurveA=move_37.Geometry, CurveB=move_38.Geometry)
end = EndPoints(Curve=move_39.Geometry)  # -> Start, End
end_2 = EndPoints(Curve=move_38.Geometry)  # -> Start, End
end_3 = EndPoints(Curve=move_40.Geometry)  # -> Start, End
end_4 = EndPoints(Curve=move_37.Geometry)  # -> Start, End
rulesrf_37 = RuledSurface(CurveA=move_41.Geometry, CurveB=move_42.Geometry)
rulesrf_38 = RuledSurface(CurveA=move_42.Geometry, CurveB=move_37.Geometry)
rulesrf_39 = RuledSurface(CurveA=move_38.Geometry, CurveB=move_41.Geometry)
Z_13 = UnitZ(Factor="988")
end_5 = EndPoints(Curve=ext_4)  # -> Start, End
end_6 = EndPoints(Curve=ext_6)  # -> Start, End
end_7 = EndPoints(Curve=ext_3)  # -> Start, End
end_8 = EndPoints(Curve=ext_5)  # -> Start, End
move_47 = Move(Geometry=move_44.Geometry, Motion=Y_15)  # -> Geometry, Transform
move_48 = Move(Geometry=move_44.Geometry, Motion=Y_17)  # -> Geometry, Transform
move_49 = Move(Geometry=move_46.Geometry, Motion=Y_16)  # -> Geometry, Transform
move_50 = Move(Geometry=move_46.Geometry, Motion=Y_18)  # -> Geometry, Transform
material_12 = CreateMaterial(Diffuse="34;47;43", Specular="255;255;255", Emission="0;0;0", Transparency="0", Shine="0.4")
Z_14 = UnitZ(Factor="12")
move_51 = Move(Geometry=move_45.Geometry, Motion=Z_12)  # -> Geometry, Transform
move_52 = Move(Geometry=move_43.Geometry, Motion=Z_12)  # -> Geometry, Transform
Z_15 = UnitZ(Factor="12")
move_53 = Move(Geometry=divide.Points, Motion=Z_13)  # -> Geometry, Transform
divide_2 = DivideCurve(Curve=ext_2, Count=round_2.Nearest, Kinks=False)  # -> Points, Tangents, Parameters
ln_19 = Line(StartPoint=end.End, EndPoint=end_2.End)
ln_20 = Line(StartPoint=end_3.End, EndPoint=end_4.End)
ln_21 = Line(StartPoint=end.Start, EndPoint=end_2.Start)
ln_22 = Line(StartPoint=end_3.Start, EndPoint=end_4.Start)
ln_23 = Line(StartPoint=end_7.Start, EndPoint=end_8.Start)
ln_24 = Line(StartPoint=end_7.End, EndPoint=end_8.End)
ln_25 = Line(StartPoint=end_5.Start, EndPoint=end_6.Start)
ln_26 = Line(StartPoint=end_5.End, EndPoint=end_6.End)
move_54 = Move(Geometry=move_48.Geometry, Motion=Z_14)  # -> Geometry, Transform
move_55 = Move(Geometry=move_47.Geometry, Motion=Z_14)  # -> Geometry, Transform
move_56 = Move(Geometry=move_50.Geometry, Motion=Z_15)  # -> Geometry, Transform
move_57 = Move(Geometry=move_49.Geometry, Motion=Z_15)  # -> Geometry, Transform
rulesrf_40 = RuledSurface(CurveA=move_43.Geometry, CurveB=move_45.Geometry)
rulesrf_41 = RuledSurface(CurveA=move_51.Geometry, CurveB=move_52.Geometry)
rulesrf_42 = RuledSurface(CurveA=move_52.Geometry, CurveB=move_43.Geometry)
rulesrf_43 = RuledSurface(CurveA=move_45.Geometry, CurveB=move_51.Geometry)
ln_27 = Line(StartPoint=divide.Points, EndPoint=move_53.Geometry)
neg_23 = Negative(Value="40")
neg_24 = Negative(Value="12")
neg_25 = Negative(Value="12")
preview_12 = CustomPreview(Geometry=[rulesrf_28, rulesrf_30, rulesrf_31, rulesrf_29], Material=material_12)
Z_16 = UnitZ(Factor="988")
rulesrf_44 = RuledSurface(CurveA=ln_19, CurveB=ln_20)
rulesrf_45 = RuledSurface(CurveA=ln_22, CurveB=ln_21)
rulesrf_46 = RuledSurface(CurveA=ln_24, CurveB=ln_19)
rulesrf_47 = RuledSurface(CurveA=ln_20, CurveB=ln_26)
rulesrf_48 = RuledSurface(CurveA=ln_26, CurveB=ln_24)
rulesrf_49 = RuledSurface(CurveA=ln_23, CurveB=ln_25)
rulesrf_50 = RuledSurface(CurveA=ln_25, CurveB=ln_22)
rulesrf_51 = RuledSurface(CurveA=ln_21, CurveB=ln_23)
rulesrf_52 = RuledSurface(CurveA=move_47.Geometry, CurveB=move_48.Geometry)
rulesrf_53 = RuledSurface(CurveA=move_54.Geometry, CurveB=move_55.Geometry)
rulesrf_54 = RuledSurface(CurveA=move_55.Geometry, CurveB=move_47.Geometry)
rulesrf_55 = RuledSurface(CurveA=move_48.Geometry, CurveB=move_54.Geometry)
rulesrf_56 = RuledSurface(CurveA=move_49.Geometry, CurveB=move_50.Geometry)
rulesrf_57 = RuledSurface(CurveA=move_56.Geometry, CurveB=move_57.Geometry)
ext_7 = ExtendCurve(Curve=move_48.Geometry, Type=0, Start=neg_24, End=neg_24)
rulesrf_58 = RuledSurface(CurveA=move_57.Geometry, CurveB=move_49.Geometry)
rulesrf_59 = RuledSurface(CurveA=move_50.Geometry, CurveB=move_56.Geometry)
ext_8 = ExtendCurve(Curve=move_47.Geometry, Type=0, Start=neg_24, End=neg_24)
ext_9 = ExtendCurve(Curve=move_56.Geometry, Type=0, Start=neg_25, End=neg_25)
ext_10 = ExtendCurve(Curve=move_57.Geometry, Type=0, Start=neg_25, End=neg_25)
material_13 = CreateMaterial(Diffuse="34;47;43", Specular="255;255;255", Emission="0;0;0", Transparency="0", Shine="0.4")
Y_19 = UnitY(Factor=neg_23)
Y_20 = UnitY(Factor="40")
move_58 = Move(Geometry=divide_2.Points, Motion=Z_16)  # -> Geometry, Transform
material_14 = CreateMaterial(Diffuse="34;47;43", Specular="255;255;255", Emission="0;0;0", Transparency="0", Shine="0.4")
end_9 = EndPoints(Curve=move_54.Geometry)  # -> Start, End
end_10 = EndPoints(Curve=move_50.Geometry)  # -> Start, End
end_11 = EndPoints(Curve=move_55.Geometry)  # -> Start, End
end_12 = EndPoints(Curve=move_49.Geometry)  # -> Start, End
end_13 = EndPoints(Curve=ext_8)  # -> Start, End
end_14 = EndPoints(Curve=ext_10)  # -> Start, End
end_15 = EndPoints(Curve=ext_7)  # -> Start, End
end_16 = EndPoints(Curve=ext_9)  # -> Start, End
move_59 = Move(Geometry=ln_27, Motion=Y_19)  # -> Geometry, Transform
move_60 = Move(Geometry=ln_27, Motion=Y_20)  # -> Geometry, Transform
ln_28 = Line(StartPoint=divide_2.Points, EndPoint=move_58.Geometry)
neg_26 = Negative(Value="40")
preview_13 = CustomPreview(Geometry=[rulesrf_32, rulesrf_34, rulesrf_35, rulesrf_33], Material=material_13)
preview_14 = CustomPreview(Geometry=[rulesrf_36, rulesrf_38, rulesrf_39, rulesrf_37], Material=material_14)
ln_29 = Line(StartPoint=end_9.End, EndPoint=end_10.End)
ln_30 = Line(StartPoint=end_11.End, EndPoint=end_12.End)
ln_31 = Line(StartPoint=end_9.Start, EndPoint=end_10.Start)
ln_32 = Line(StartPoint=end_11.Start, EndPoint=end_12.Start)
material_15 = CreateMaterial(Diffuse="34;47;43", Specular="255;255;255", Emission="0;0;0", Transparency="0", Shine="0.4")
ln_33 = Line(StartPoint=end_15.Start, EndPoint=end_16.Start)
ln_34 = Line(StartPoint=end_15.End, EndPoint=end_16.End)
ln_35 = Line(StartPoint=end_13.Start, EndPoint=end_14.Start)
ln_36 = Line(StartPoint=end_13.End, EndPoint=end_14.End)
Y_21 = UnitY(Factor=neg_26)
Y_22 = UnitY(Factor="40")
X_7 = UnitX(Factor="12")
material_16 = CreateMaterial(Diffuse="34;47;43", Specular="255;255;255", Emission="0;0;0", Transparency="0", Shine="0")
material_17 = CreateMaterial(Diffuse="34;47;43", Specular="255;255;255", Emission="0;0;0", Transparency="0", Shine="0.4")
rulesrf_60 = RuledSurface(CurveA=ln_29, CurveB=ln_30)
rulesrf_61 = RuledSurface(CurveA=ln_32, CurveB=ln_31)
rulesrf_62 = RuledSurface(CurveA=ln_34, CurveB=ln_29)
rulesrf_63 = RuledSurface(CurveA=ln_30, CurveB=ln_36)
move_61 = Move(Geometry=ln_28, Motion=Y_21)  # -> Geometry, Transform
move_62 = Move(Geometry=ln_28, Motion=Y_22)  # -> Geometry, Transform
material_18 = CreateMaterial(Diffuse="34;47;43", Specular="255;255;255", Emission="0;0;0", Transparency="0", Shine="0")
move_63 = Move(Geometry=move_60.Geometry, Motion=X_7)  # -> Geometry, Transform
move_64 = Move(Geometry=move_59.Geometry, Motion=X_7)  # -> Geometry, Transform
rulesrf_64 = RuledSurface(CurveA=ln_36, CurveB=ln_34)
rulesrf_65 = RuledSurface(CurveA=ln_33, CurveB=ln_35)
rulesrf_66 = RuledSurface(CurveA=ln_35, CurveB=ln_32)
rulesrf_67 = RuledSurface(CurveA=ln_31, CurveB=ln_33)
preview_15 = CustomPreview(Geometry=[rulesrf_40, rulesrf_42, rulesrf_43, rulesrf_41], Material=material_15)
preview_16 = CustomPreview(
    Geometry=[rulesrf_45, rulesrf_44, rulesrf_47, rulesrf_46, rulesrf_48, rulesrf_49, rulesrf_50, rulesrf_51],
    Material=material_16)
preview_17 = CustomPreview(Geometry=[rulesrf_52, rulesrf_54, rulesrf_55, rulesrf_53], Material=material_17)
preview_18 = CustomPreview(Geometry=[rulesrf_56, rulesrf_58, rulesrf_59, rulesrf_57], Material=material_18)
X_8 = UnitX(Factor="12")
rulesrf_68 = RuledSurface(CurveA=move_64.Geometry, CurveB=move_63.Geometry)
rulesrf_69 = RuledSurface(CurveA=move_59.Geometry, CurveB=move_64.Geometry)
rulesrf_70 = RuledSurface(CurveA=move_63.Geometry, CurveB=move_60.Geometry)
rulesrf_71 = RuledSurface(CurveA=move_60.Geometry, CurveB=move_59.Geometry)
move_65 = Move(Geometry=move_62.Geometry, Motion=X_8)  # -> Geometry, Transform
move_66 = Move(Geometry=move_61.Geometry, Motion=X_8)  # -> Geometry, Transform
material_19 = CreateMaterial(Diffuse="34;47;43", Specular="255;255;255", Emission="0;0;0", Transparency="0", Shine="0")
rulesrf_72 = RuledSurface(CurveA=move_66.Geometry, CurveB=move_65.Geometry)
rulesrf_73 = RuledSurface(CurveA=move_61.Geometry, CurveB=move_66.Geometry)
rulesrf_74 = RuledSurface(CurveA=move_65.Geometry, CurveB=move_62.Geometry)
rulesrf_75 = RuledSurface(CurveA=move_62.Geometry, CurveB=move_61.Geometry)
preview_19 = CustomPreview(
    Geometry=[rulesrf_61, rulesrf_60, rulesrf_63, rulesrf_62, rulesrf_64, rulesrf_65, rulesrf_66, rulesrf_67],
    Material=material_19)
material_20 = CreateMaterial(Diffuse="34;47;43", Specular="255;255;255", Emission="0;0;0", Transparency="0", Shine="0.4")
preview_20 = CustomPreview(Geometry=[rulesrf_69, rulesrf_68, rulesrf_71, rulesrf_70], Material=material_20)
material_21 = CreateMaterial(Diffuse="34;47;43", Specular="255;255;255", Emission="0;0;0", Transparency="0", Shine="0")
preview_21 = CustomPreview(Geometry=[rulesrf_73, rulesrf_72, rulesrf_75, rulesrf_74], Material=material_21)
